# Grasshopper definition 02_Full_Model.gh (Grasshopper 1.0.7)

geo_second_floor_windows = Geometry([<brep referenced from the Rhino model> x12])
# CREATE HB ROOMS [ZONES]
# SECOND FLOOR LEVEL
brep_second_floor = Brep([<brep referenced from the Rhino model> x6])
geo_first_floor_windows = Geometry([<brep referenced from the Rhino model> x12])
# FIRST FLOOR LEVEL
brep_first_floor = Brep([<brep referenced from the Rhino model> x6])

get_surface_params = LBT2PH_GetSrfcParams(srfcs=brep_first_floor)  # -> out, geo, name, type, bc, ep_const, rad_mod; inputs srfcs: list of GeometryBase; plug-in component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
face = HBFace(
    geo=get_surface_params.geo,
    name=get_surface_params.name,
    type=get_surface_params.type,
    bc=get_surface_params.bc,
    ep_constr=get_surface_params.ep_const)  # -> report, faces; plug-in component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

aperture = HBAperture(geo=geo_first_floor_windows)  # -> report, apertures; plug-in component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
phpp_aperture = LBT2PH_CreatePHPPAperture(apertures=aperture.apertures)  # -> out, apertures; inputs apertures: list, frames: list, glazings: list, installs: list; plug-in component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

get_surface_params_2 = LBT2PH_GetSrfcParams(srfcs=brep_second_floor)  # -> out, geo, name, type, bc, ep_const, rad_mod; inputs srfcs: list of GeometryBase; plug-in component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
face_2 = HBFace(
    geo=get_surface_params_2.geo,
    name=get_surface_params_2.name,
    type=get_surface_params_2.type,
    bc=get_surface_params_2.bc,
    ep_constr=get_surface_params_2.ep_const)  # -> report, faces; plug-in component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

aperture_2 = HBAperture(geo=geo_second_floor_windows)  # -> report, apertures; plug-in component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
phpp_aperture_2 = LBT2PH_CreatePHPPAperture(apertures=aperture_2.apertures)  # -> out, apertures; inputs apertures: list, frames: list, glazings: list, installs: list; plug-in component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

addsubface = HBAddSubface(hb_obj=flatten(face.faces), sub_faces=flatten(phpp_aperture.apertures))  # -> hb_obj; plug-in component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
addsubface_2 = HBAddSubface(hb_obj=flatten(face_2.faces), sub_faces=flatten(phpp_aperture_2.apertures))  # -> hb_obj; plug-in component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
room = HBRoom(faces=flatten(addsubface), name="First_Floor", conditioned=True)  # -> report, room; plug-in component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
room_2 = HBRoom(faces=flatten(addsubface_2), name="Second_Floor", conditioned=True)  # -> report, room; plug-in component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
expression = Expression(Expression="23/24")
expression_2 = Expression(Expression="1/24")
phpp_vent_sched = LBT2PH_CreateRoomVentSched(operationTime_high=expression_2, operationTime_med=expression)  # -> out, phpp_ventilation_sched; plug-in component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
brep_living_room = Brep(<brep referenced from the Rhino model>)
brep_tfa_surfaces = Brep([<brep referenced from the Rhino model> x9])
brep_tfa_surfaces_2 = Brep([<brep referenced from the Rhino model> x5])
phpp_spaces = LBT2PH_CreatePHPPSpaces(
    TFA_surfaces=flatten(brep_tfa_surfaces),
    spaces_geometry=flatten(brep_living_room),
    vent_flowrate_source="UD",
    phpp_vent_schedule=phpp_vent_sched.phpp_ventilation_sched,
    HB_rooms=room.room)  # -> out, space_breps, phpp_spaces, HB_rooms; inputs TFA_surfaces: list, spaces_geometry: list of Guid, HB_rooms: list, set_honeybee_loads: Boolean; plug-in component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
phpp_spaces_2 = LBT2PH_CreatePHPPSpaces(
    TFA_surfaces=flatten(brep_tfa_surfaces_2),
    vent_flowrate_source="UD",
    phpp_vent_schedule=phpp_vent_sched.phpp_ventilation_sched,
    HB_rooms=room_2.room)  # -> out, space_breps, phpp_spaces, HB_rooms; inputs TFA_surfaces: list, spaces_geometry: list of Guid, HB_rooms: list, set_honeybee_loads: Boolean; plug-in component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
merge = Merge(Data1=phpp_spaces_2.HB_rooms, Data2=phpp_spaces.HB_rooms)
solveadj = HBSolveAdjacency(rooms=flatten(merge), run=Toggle(True))  # -> report, adj_rooms; plug-in component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
panel = Panel("http://climate.onebuilding.org/WMO_Region_4_North_and_Central_America/USA_United_States_of_America/NY_New_York/USA_NY_New.York-Kennedy.Intl.AP.744860_TMY3.zip")
downloadepw = LBDownloadWeather(weather_URL=panel)  # -> epw_file, stat_file, ddy_file; plug-in component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
create_window_reveals = LBT2PH_CreateWindowReveals(HB_rooms=flatten(solveadj.adj_rooms))  # -> out, HB_rooms, port, window_names, window_surfaces, port_2, window_surrounds, envelope_surfaces_punched, envelope_surfaces; inputs HB_rooms: list; plug-in component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
brep_overhang = Brep(<brep referenced from the Rhino model>)
brep_neighbor = Brep(<brep referenced from the Rhino model>)
brep_roof = Brep([<brep referenced from the Rhino model> x2])
importepw = LBImportEPW(epw_file=downloadepw.epw_file)  # -> location, dry_bulb_temperature, dew_point_temperature, relative_humidity, wind_speed, wind_direction, direct_normal_rad, diffuse_horizontal_rad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; plug-in component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
merge_2 = Merge(Data1=brep_roof, Data2=brep_neighbor, Data3=brep_overhang)
smooth = SettingsQuality()
data = Data(importepw.diffuse_horizontal_rad)
data_2 = Data(importepw.location)
data_3 = Data(importepw.direct_normal_rad)

# ---- group: Winter
data_diff_rad = Data(data)
data_location = Data(data_2)
data_direct_rad = Data(data_3)
# SHADING
panel_2 = Panel("11")
analysisperiod = LBAnalysisPeriod(start_month=panel_2, start_day=1, start_hour=0, end_month="4", end_day="15")  # -> period, hoys, dates; plug-in component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
skymatrix = LBCumulativeSkyMatrix(location=data_location, direct_rad=data_direct_rad, diffuse_rad=data_diff_rad, hoys=analysisperiod.hoys)  # -> report, sky_mtx; plug-in component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

# ---- group: Summer
data_diff_rad_2 = Data(data)
data_location_2 = Data(data_2)
data_direct_rad_2 = Data(data_3)
analysisperiod_2 = LBAnalysisPeriod(start_month="5", start_day=1, start_hour=0, end_month="9")  # -> period, hoys, dates; plug-in component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
skymatrix_2 = LBCumulativeSkyMatrix(location=data_location_2, direct_rad=data_direct_rad_2, diffuse_rad=data_diff_rad_2, hoys=analysisperiod_2.hoys)  # -> report, sky_mtx; plug-in component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

# ----
seasonal_radiation_from_lbt = LBT2PH_GenLBTSeasonalRadiation(
    winter_sky_mtx=skymatrix.sky_mtx,
    summer_sky_mtx=skymatrix_2.sky_mtx,
    shading_Mesh_Settings=smooth,
    grid_size="0.1",
    HB_rooms=create_window_reveals.HB_rooms,
    window_names=flatten(create_window_reveals.window_names),
    window_surfaces=flatten(create_window_reveals.window_surfaces),
    window_surrounds=simplify(create_window_reveals.window_surrounds),
    envelope_surfaces_punched=flatten(create_window_reveals.envelope_surfaces_punched),
    additional_shading_surfaces=flatten(merge_2),
    run=Toggle(False))  # -> out, HB_rooms, window_names, winter_radiation_shaded, winter_radiation_unshaded, summer_radiation_shaded, summer_radiation_unshaded, port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; inputs HB_rooms: list, window_names: list, window_surfaces: list of GeometryBase, window_surrounds: tree of GeometryBase, envelope_surfaces_punched: list of GeometryBase, additional_shading_surfaces: list of GeometryBase, parallel: Boolean, run: Boolean; plug-in component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
division = Division(A=seasonal_radiation_from_lbt.winter_radiation_shaded, B=seasonal_radiation_from_lbt.winter_radiation_unshaded)
division_2 = Division(A=seasonal_radiation_from_lbt.summer_radiation_shaded, B=seasonal_radiation_from_lbt.summer_radiation_unshaded)
apply_win_shading_factors = LBT2PH_ApplyWindowShadingFactors(
    HB_rooms=seasonal_radiation_from_lbt.HB_rooms,
    window_names=flatten(seasonal_radiation_from_lbt.window_names),
    winter_shading_factors=flatten(division),
    summer_shading_factors=flatten(division_2))  # -> out, HB_rooms; inputs HB_rooms: list, window_names: list, winter_shading_factors: list, summer_shading_factors: list; plug-in component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
vent_duct = LBT2PH_CreateNewPHPPVentDuct(ductLength=flatten("6'"), ductWidth="6\"", insulThickness="4in")  # -> out, hrvDuct; inputs ductLength: list, ductWidth: list, insulThickness: list, insulConductivity: list; plug-in component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
# FRESH-AIR VENT.
panel_3 = Panel("Zehnder ComfoAir Q600ERV")
ventilator = LBT2PH_CreateNewPHPPVentUnit(name=panel_3, HR_eff="80", MR_eff="68", elec_eff="0.22", frost_temp="-8")  # -> out, ventUnit; plug-in component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
crv = Curve(<curve referenced from the Rhino model>)
create_vent_system = LBT2PH_CreateNewPHPPVentSystem(
    vent_system_type="1-Balanced PH ventilaiton with HR",
    vent_system_name="Whole-House",
    vent_unit=ventilator.ventUnit,
    hrv_duct_01=crv,
    hrv_duct_02=vent_duct.hrvDuct,
    HB_rooms=apply_win_shading_factors.HB_rooms)  # -> out, HB_rooms; inputs hrv_duct_01: list, hrv_duct_02: list, exhaust_vent_units: list, HB_rooms: list; plug-in component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
panel_4 = Panel("""-27.6	24.1	5.66	4.51
-23.0	24.6	6.52	3.39
-18.4	25.1	7.38	2.84
-13.8	25.5	8.24	2.60
-9.7	26.6	10.21	2.64
-5.5	27.6	12.06	2.43
-26.3	23.2	2.83	2.47
-21.5	23.5	3.26	2.66
-16.7	23.9	3.69	2.89
-11.9	24.2	4.12	3.06
-7.3	24.9	5.11	3.39
-2.8	25.6	6.03	3.38""")
kw = Panel("3")
cfm = Panel("600 cfm")
# Heating / Cooling
panel_5 = Panel("DHW HP")
heating_hp_options = LBT2PH_Heating_ASHP_Options(design_forward_water_temp="24", hp_distribution="2-Radiators")  # -> out, hp_options; plug-in component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
cooling_recirc = LBT2PH_CreateCooling_Recirc(max_cooling_cap=kw, vol_flow_at_nom_power=cfm)  # -> out, recirc_air_cooling; inputs on_off_mode: Boolean, variable_vol: Boolean; plug-in component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
heating_hp = LBT2PH_Heating_ASHP(unit_name=panel_5)  # -> out, heat_pump; inputs fromPHPP: list, temps_source: list, temps_sink: list, heating_capacities: list, COPs: list; plug-in component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
heating_hp_2 = LBT2PH_Heating_ASHP(unit_name="Eds Custom ASHP", fromPHPP=panel_4, dt_sink="0")  # -> out, heat_pump; inputs fromPHPP: list, temps_source: list, temps_sink: list, heating_capacities: list, COPs: list; plug-in component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
heating_cooling_systems = LBT2PH_SetSystems(
    primary_heat_generation="2-Heat Pump(s)",
    secondary_heat_generation="5-Direct Electric",
    dhw_frac_primary="0",
    mech_cooling=Toggle(True),
    hp_heating=heating_hp_2.heat_pump,
    hp_DHW=heating_hp.heat_pump,
    hp_options=heating_hp_options.hp_options,
    recirc_air_cooling=cooling_recirc.recirc_air_cooling,
    HB_rooms=create_vent_system.HB_rooms)  # -> out, HB_rooms; inputs mech_cooling: Boolean, HB_rooms: list; plug-in component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
ga = Panel("80Ga")
panel_6 = Panel("4")
dhw_tank = LBT2PH_DHW_Tank(tank_type="2-DHW only", tank_HLrate=panel_6, tank_volume=ga, tank_standby_frac="0.3")  # -> out, storage_tank; inputs tank_solar: Boolean; plug-in component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
crv_branch_piping = Curve([<curve referenced from the Rhino model> x5])
# DHW
crv_recirc_loop = Curve([<curve referenced from the Rhino model> x2])
dhw = LBT2PH_DHW_System(
    system_name="Whole-House DHW",
    circulation_piping=crv_recirc_loop,
    branch_piping=crv_branch_piping,
    tank1=dhw_tank.storage_tank,
    HB_rooms=heating_cooling_systems.HB_rooms)  # -> out, HB_rooms; inputs circulation_piping: list, branch_piping: list, HB_rooms: list; plug-in component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
ach_50 = Panel("0.6")
pa = Panel("50")
# NAT. AIRFLOW
airtightness = LBT2PH_Airtightness(HB_rooms=flatten(dhw.HB_rooms), n50=ach_50, blower_pressure=pa)  # -> out, HB_rooms; inputs HB_rooms: list; plug-in component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
ach = Panel("1.0")
summervent = LBT2PH_SummerVentilation(HB_rooms=airtightness.HB_rooms, use_default=Toggle(True), nighttime_ach=ach)  # -> out, HB_rooms; inputs HB_rooms: list, use_default: Boolean; plug-in component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
model = HBModel(rooms=flatten(summervent.HB_rooms), name="Eds_First_House")  # -> report, model; plug-in component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
# MODEL CONFIG.
phpp_occupancy = LBT2PH_SetPHPPOccupancy(set_honeybee_loads=False, HB_model=model.model)  # -> out, occupancy_sch, ppl_per_area, HB_model; inputs set_honeybee_loads: Boolean; plug-in component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
phpp_setup = LBT2PH_SetPHPPSetup(HB_model=phpp_occupancy.HB_model, primary_energy="2-PER Renewable")  # -> out, HB_model; plug-in component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
data_to_phpp = Data(phpp_setup.HB_model)
data_to_osm = Data(phpp_setup.HB_model)
lbt_phpp = LBT2PH_ConvertLBT2PHPPObjs(HB_model=data_to_phpp)  # -> out, footprint, excel_objects; inputs rooms_included: list, rooms_excluded: list, ud_row_starts: list, estimated_tfa: Boolean, ud_custom: list; plug-in component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
path = FilePath("C:\LBT2PH_example\Source_PHPP_File.xlsx")
# EXPORT TO PHPP
panel_7 = Panel(path)
open_xl_workbook = LBT2PH_XLOpenWorkbook(run=Toggle(False), source_PHPP_filepath=panel_7, new_PHPP_filepath="C:\LBT2PH_example\My_Results.xlsx")  # -> excel; inputs run: Boolean; plug-in component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
write_xl_workbook = LBT2PH_XLWriteWorkbook(excel=open_xl_workbook, useDiff=Toggle(True), XL_Objects=lbt_phpp.excel_objects)  # -> excel, numWrites; inputs XL_Objects: tree; plug-in component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
panel_8 = Panel(write_xl_workbook.numWrites)
