# Grasshopper definition LBT_1_Testing.gh (Grasshopper 1.0.7)

new_phpp_frame = BT_CreatePHPPwindowFrame()  # -> out, PHPPFrame; inputs frameWidths: list, frameUvalues: list, psiGlazings: list, psiInstalls: list; plug-in component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
phpp_glazing = GhPythonScript()  # -> out, PHPP_glazing
# ---------- phpp_glazing: Python ----------
import LBT2PH.windows
reload(LBT2PH.windows)

PHPP_glazing_ = LBT2PH.windows.PHPP_Glazing()
# ---------- end phpp_glazing ----------
phpp_glazing_2 = GhPythonScript()  # -> out, PHPP_glazing; same code as phpp_glazing
geo = Geometry([<brep referenced from the Rhino model> x6])
get_surface_params = GhPythonScript(srfcs=geo, auto_orientation=Toggle(True))  # -> out, geo, name, type, bc, ep_const, rad_mod; inputs srfcs: list of Guid
# ---------- get_surface_params: Python ----------
import rhinoscriptsyntax as rs
import scriptcontext as sc
import Rhino
import ghpythonlib.components as ghc
from imp import reload
import LBT2PH
import LBT2PH.helpers
import LBT2PH.assemblies
import LBT2PH.surfaces

#-------------------------------------------------------------------------------
reload(LBT2PH)
reload(LBT2PH.helpers)
reload(LBT2PH.assemblies)
reload(LBT2PH.surfaces)

#-------------------------------------------------------------------------------
def cleanSrfcInput(_srfcsInput):
    """If Brep or Polysrfc are input, explode them"""
    
    outputSrfcs = []
    
    with LBT2PH.helpers.context_rh_doc(ghdoc):
        for inputObj in _srfcsInput:
            if isinstance(rs.coercesurface(inputObj), Rhino.Geometry.BrepFace):
                # Catches Bare surfaces
                outputSrfcs.append(inputObj)
            elif isinstance(rs.coercebrep(inputObj), Rhino.Geometry.Brep):
                # Catches Polysurfaces / Extrusions or other Masses
                faces = ghc.DeconstructBrep(rs.coercebrep(inputObj)).faces
                if isinstance(faces, list):
                    for face in faces:
                        outputSrfcs.append(face)
            elif isinstance(rs.coercegeometry(inputObj), Rhino.Geometry.PolylineCurve):
                # Catches PolylineCurves
                if not rs.coercegeometry(inputObj).IsClosed:
                    warn = 'Non-Closed Polyline Curves found. Make sure all curves are closed.'
                    ghenv.Component.AddRuntimeMessage(ghK.GH_RuntimeMessageLevel.Remark, warn)
                else:
                    faces = ghc.DeconstructBrep(rs.coercegeometry(inputObj)).faces
                    if isinstance(faces, list):
                        for face in faces:
                            outputSrfcs.append(face)
                    else:
                        outputSrfcs.append(faces)
    
    return outputSrfcs

#-------------------------------------------------------------------------------
# Get the Surface data from the RH Scene
srfcs_to_use = cleanSrfcInput(_srfcs)
rh_surfaces = LBT2PH.surfaces.get_rh_srfc_params(srfcs_to_use, ghenv, ghdoc)

if auto_orientation_:
    rh_surfaces = LBT2PH.surfaces.determine_surface_type_by_orientation(rh_surfaces)

#-------------------------------------------------------------------------------
# Get all the Assemblies from the RH Scene
rh_doc_constructions = LBT2PH.assemblies.get_constructions_from_rh(ghdoc)
hb_constructions = LBT2PH.assemblies.generate_all_HB_constructions(rh_doc_constructions, ghenv, sc.sticky)

#-------------------------------------------------------------------------------
# Create the surface objects
hb_surfaces = [LBT2PH.surfaces.hb_surface(srfc, hb_constructions, ghenv) for srfc in rh_surfaces]

#-------------------------------------------------------------------------------
# Outputs
geo_ = []
name_ = []
type_ = []
bc_ = []
ep_const_ = []
rad_mod_ = []
for hb_srfc in hb_surfaces:
    geo_.append(hb_srfc.geometry)
    name_.append(hb_srfc.name)
    type_.append(hb_srfc.type)
    bc_.append(hb_srfc.bc)
    ep_const_.append(hb_srfc.const)
    rad_mod_.append(hb_srfc.rad_mod)
# ---------- end get_surface_params ----------
new_phpp_glazing = BT_CreatePHPPwindowGlazing()  # -> out, PHPPGlazing; plug-in component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
panel = Panel(phpp_glazing.PHPP_glazing)
panel_2 = Panel(phpp_glazing_2.PHPP_glazing)
merge = Merge(Data1=phpp_glazing.PHPP_glazing, Data2=phpp_glazing_2.PHPP_glazing)
geo_2 = Geometry([<brep referenced from the Rhino model> x2])
aperture = HBAperture(geo=geo_2)  # -> report, apertures; plug-in component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

# ---- group: Dynamically Chage Glazing Ratio
number_slider = Slider(0.4, range=-0.1..0.9)

# ----
# Create Honeybee Model
panel_3 = Panel("outdoors")
geo_3 = Geometry([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])
geo_4 = Geometry(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)
face = HBFace(geo=geo_3, bc=panel_3)  # -> report, faces; plug-in component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
face_2 = HBFace(geo=geo_4, bc="adiabatic")  # -> report, faces; plug-in component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
aperturesbyratio = HBAperturesByRatio(hb_objs=flatten(face.faces), ratio=number_slider)  # -> report, hb_objs; plug-in component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
all_air = HBAllAirHVACTemplates({"VAV chiller with gas boiler reheat", "VAV chiller with central air source heat pump reheat", "VAV chiller with district hot water reheat", "VAV chiller with PFP boxes", "VAV chiller with gas coil reheat", "VAV air-cooled chiller with gas boiler reheat", "VAV air-cooled chiller with central air source heat pump reheat", "VAV air-cooled chiller with district hot water reheat", "VAV air-cooled chiller with PFP boxes", "VAV air-cooled chiller with gas coil reheat"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}, selected="VAV chiller with gas boiler reheat")
room = HBRoom(
    faces=flatten([face_2.faces, aperturesbyratio.hb_objs]),
    name="Office Shoe Box",
    constr_set="2013::ClimateZone5::SteelFramed",
    program="2013::LargeOffice::OpenOffice",
    conditioned=True)  # -> report, room; plug-in component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
panel_4 = Panel("DifferentialDryBulb")
concat = Concatenate(FragmentA="ShoeBox", FragmentB=number_slider)
allairhvac = HBAllAirHVAC(rooms=flatten(room.room), system_type=all_air, name="VAV System")  # -> report, rooms; plug-in component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
model = HBModel(rooms=flatten(allairhvac.rooms), name=concat)  # -> report, model; plug-in component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

face_3 = HBFace(
    geo=get_surface_params.geo,
    name=get_surface_params.name,
    type=get_surface_params.type,
    bc=get_surface_params.bc,
    ep_constr=get_surface_params.ep_const)  # -> report, faces; plug-in component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
new_phpp_window = BT_CreatePHPPwindow()  # -> out, HBZones, windowSurfaces, windowNames, EPConstructions, windowObjs; inputs HBZones: list, names: list, frames: list, glazings: list, psi_installs: list, installs: list, EPConsts: list, windowGeom: list; plug-in component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
phpp_window = GhPythonScript(apertures=aperture.apertures)  # -> out, apertures; inputs apertures: list, frames: list, glazings: list, psi_installs: list, installs: list
# ---------- phpp_window: Python ----------
import System
import Rhino
import rhinoscriptsyntax as rs

import LBT2PH
import LBT2PH.windows
reload(LBT2PH)
reload(LBT2PH.windows)

def aperture_sources():
    ''' Find the component input source with the name "apertures" '''
    
    for input in ghenv.Component.Params.Input:
        if input.NickName == 'apertures':
            return input.Sources[0]
    
    return None

def window_rh_Guids():
    ''' Work backwards to get the Guid of the original input geom '''
    
    apertures = aperture_sources()
    if apertures is None:
        return None
    
    hb_aperture_compo = apertures.Attributes.GetTopLevel.DocObject
    
    rh_doc_window_guids = []
    for input in hb_aperture_compo.Params.Input[0].VolatileData[0]:
        guid_as_str = input.ReferenceID.ToString() 
        
        try:
            rh_doc_window_guids.append( System.Guid(guid_as_str) )
        except:
            rh_doc_window_guids.append( None )
    
    
    #rh_doc_window_guids = [input.ReferenceID.ToString() 
                           #for input in 
                           #hb_aperture_compo.Params.Input[0].VolatileData[0]]
    
    return rh_doc_window_guids

def cleanInput(_inputList, targetListLength,):
    # Used to make sure the input lists are all the same length
    # if the input param list isn't the same, use only the first item for all
    
    output = []
    if len(_inputList) == targetListLength:
        for each in _inputList:
            output.append(each)
    elif len(_inputList) >= 1:
        for i in range(targetListLength):
            output.append(_inputList[0])
    elif len(_inputList) == 0:
        for i in range(targetListLength):
            output.append(None)
    
    return output

#-------------------------------------------------------------------------------
# Clean the GH component inputs
ud_frames = cleanInput(frames_, len(apertures))
ud_glazings = cleanInput(glazings_, len(apertures))
ud_psi_installs = cleanInput(psi_installs_, len(apertures))
ud_installs = cleanInput(installs_, len(apertures))
gh_inputs = zip(ud_frames, ud_glazings, ud_psi_installs,  ud_installs)

#-------------------------------------------------------------------------------
# Get the Rhino Scene UserText (window Library)
rh_doc_window_library = LBT2PH.windows.get_rh_doc_window_library(ghdoc)

window_guids = window_rh_Guids()
for aperture, window_guid, gh_input in zip(apertures, window_guids, gh_inputs):
    #---------------------------------------------------------------------------
    # Get the Window data from the scene (name, params, etc)
    window_params = LBT2PH.windows.get_rh_window_obj_params(ghdoc, window_guid )
    ud_f, ud_g, ud_psi, ud_i = gh_input
    
    if ud_f: window_params['FrameType'] = ud_f
    if ud_g: window_params['GlazingType'] = ud_g
    if ud_psi: window_params['FrameType'] = ud_psi
    if ud_i:
        window_params['InstallLeft'] = ud_i
        window_params['InstallRight'] = ud_i
        window_params['InstallBottom'] = ud_i
        window_params['InstallTop'] = ud_i
    
    print window_params
    
    #---------------------------------------------------------------------------
    # Create a new 'Window' Object based on the aperture, params, component library
    window_obj = LBT2PH.windows.PHPP_Window(aperture, window_params, rh_doc_window_library)
     
    #---------------------------------------------------------------------------
    # Create EP Constructions for each window (based on frame / glass)
    window_EP_material = LBT2PH.windows.create_EP_window_mat( window_obj )
    window_EP_const = LBT2PH.windows.create_EP_const( window_EP_material )
    aperture.properties.energy.construction = window_EP_const
    
    #---------------------------------------------------------------------------
    # Package up the data onto the 'Aperture' objects
    if aperture.user_data is None:
        aperture.user_data = {}
    if not aperture.user_data.has_key('phpp'):
        aperture.user_data['phpp'] = {}
        aperture.user_data['phpp']['aperture_params'] = window_params
    else:
        aperture.user_data['phpp']['aperture_params'] = window_params
# ---------- end phpp_window ----------
room_2 = HBRoom(faces=flatten(face_3.faces), name="Test Room", conditioned=True)  # -> report, room; plug-in component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
idf2phpp = BT_CORE()  # -> out; plug-in component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
panel_5 = Panel(phpp_window.apertures)
addsubface = HBAddSubface(hb_obj=flatten(room_2.room), sub_faces=flatten(phpp_window.apertures))  # -> hb_obj; plug-in component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

# ----
# Request Outputs
toggle = BooleanToggle(True)
simoutput = HBSimulationOutput(zone_energy_use=toggle, hvac_energy_use=toggle)  # -> report, sim_output; plug-in component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
simpar = HBSimulationParameter(output=simoutput.sim_output, timestep=6)  # -> sim_par; plug-in component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

model_2 = HBModel(rooms=flatten(addsubface), name="Test Model")  # -> report, model; plug-in component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
panel_6 = Panel(model_2.model)

# ----
# Download EPW File
panel_7 = Panel("https://www.energyplus.net/weather-download/north_and_central_america_wmo_region_4/USA/MA/USA_MA_Boston-Logan.Intl.AP.725090_TMY3/all")
downloadepw = LBDownloadWeather(weather_URL=panel_7)  # -> epw_file, stat_file, ddy_file; plug-in component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

vizbytype = HBVisualizeByType(rooms=model_2.model)  # -> walls, interior_walls, roofs, ceilings, exterior_floors, interior_floors, air_walls, apertures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; plug-in component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
python = GhPythonScript(model=model_2.model)  # -> out, a; inputs model: list
# ---------- python: Python ----------
for m in model:
    for a in m.apertures:
        print a.user_data
        print a.properties.energy.construction
# ---------- end python ----------
panel_8 = Panel(python.out)
connect_to_run__to_only_write_idf = Panel("2")
toggle_2 = BooleanToggle(False)
vizbytype_2 = HBVisualizeByType(rooms=model.model)  # -> walls, interior_walls, roofs, ceilings, exterior_floors, interior_floors, air_walls, apertures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; plug-in component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
modeltoosm = HBModelToOSM(model=model.model, epw_file=downloadepw.epw_file, sim_par=simpar, write=toggle_2, run=toggle_2)  # -> report, jsons, osw, osm, idf, sql, zsz, rdd, html; plug-in component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

# ----
# Visualize Results
roomenergyresult = HBReadRoomEnergyResult(sql=modeltoosm.sql)  # -> cooling, heating, lighting, electric_equip, gas_equip, fan_electric, pump_electric, people_gain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; plug-in component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
hourlyplot = LBHourlyPlot(data=[roomenergyresult.cooling, roomenergyresult.heating, roomenergyresult.fan_electric, roomenergyresult.pump_electric])  # -> report, mesh, legend, borders, labels, title; plug-in component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

# ----
# Optionally Execute Simulations in Parallel
data = Data(modeltoosm.osw)
data_2 = Data(modeltoosm.idf)
data_3 = Data(downloadepw.epw_file)
rec = DataRecorder(data, DataLimit=-10, RecordData=True)
rec_2 = DataRecorder(data_2, DataLimit=-10, RecordData=True)
toggle_3 = BooleanToggle(False)
runidf = HBRunIDF(idf=rec_2, epw_file=data_3, parallel=Toggle(True), run=Toggle(False))  # -> report, sql, zsz, rdd, html; plug-in component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
runosw = HBRunOSW(osw=rec, epw_file=data_3, parallel=Toggle(True), translate=toggle_3, run=toggle_3)  # -> report, osm, idf, sql, zsz, rdd, html; plug-in component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
