# Grasshopper definition 201120_LBT_Testing [Nov-21 '20, 1332].gh (Grasshopper 1.0.7)

# ---- group: Dynamically Chage Glazing Ratio
number_slider = Slider(0.4, range=-0.1..0.9)  # disabled

# ----
# Create Honeybee Model
panel = Panel("outdoors")  # disabled
panel_2 = Panel("adiabatic")  # disabled
geo = Geometry([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])  # disabled
geo_2 = Geometry(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)  # disabled
face = HBFace(geo=geo, bc=panel)  # -> report, faces; disabled; plug-in component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
face_2 = HBFace(geo=geo_2, bc=panel_2)  # -> report, faces; disabled; plug-in component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
panel_3 = Panel("2013::LargeOffice::OpenOffice")  # disabled
panel_4 = Panel("2013::ClimateZone5::SteelFramed")  # disabled
aperturesbyratio = HBAperturesByRatio(hb_objs=flatten(face.faces), ratio=number_slider)  # -> report, hb_objs; disabled; plug-in component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
all_air = HBAllAirHVACTemplates({"VAV chiller with gas boiler reheat", "VAV chiller with central air source heat pump reheat", "VAV chiller with district hot water reheat", "VAV chiller with PFP boxes", "VAV chiller with gas coil reheat", "VAV air-cooled chiller with gas boiler reheat", "VAV air-cooled chiller with central air source heat pump reheat", "VAV air-cooled chiller with district hot water reheat", "VAV air-cooled chiller with PFP boxes", "VAV air-cooled chiller with gas coil reheat"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}, selected="VAV chiller with gas boiler reheat")  # disabled
panel_5 = Panel("Office Shoe Box")  # disabled
panel_6 = Panel("ShoeBox")  # disabled
room = HBRoom(
    faces=flatten([face_2.faces, aperturesbyratio.hb_objs]),
    name=panel_5,
    constr_set=panel_4,
    program=panel_3,
    conditioned=True)  # -> report, room; disabled; plug-in component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
panel_7 = Panel("DifferentialDryBulb")  # disabled
concat = Concatenate(FragmentA=panel_6, FragmentB=number_slider)  # disabled
panel_8 = Panel("VAV System")  # disabled
allairhvac = HBAllAirHVAC(rooms=flatten(room.room), system_type=all_air, name=panel_8)  # -> report, rooms; disabled; plug-in component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
model = HBModel(rooms=flatten(allairhvac.rooms), name=concat)  # -> report, model; disabled; plug-in component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

# ----
# Request Outputs
toggle = BooleanToggle(True)  # disabled
simoutput = HBSimulationOutput(zone_energy_use=toggle, hvac_energy_use=toggle)  # -> report, sim_output; disabled; plug-in component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
simpar = HBSimulationParameter(output=simoutput.sim_output, timestep=6)  # -> sim_par; disabled; plug-in component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

# ----
# Download EPW File
panel_9 = Panel("https://www.energyplus.net/weather-download/north_and_central_america_wmo_region_4/USA/MA/USA_MA_Boston-Logan.Intl.AP.725090_TMY3/all")  # disabled
downloadepw = LBDownloadWeather(weather_URL=panel_9)  # -> epw_file, stat_file, ddy_file; disabled; plug-in component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

panel_10 = Panel(simpar)  # disabled
connect_to_run__to_only_write_idf = Panel("2")  # disabled
toggle_2 = BooleanToggle(False)  # disabled
vizbytype = HBVisualizeByType(rooms=model.model)  # -> walls, interior_walls, roofs, ceilings, exterior_floors, interior_floors, air_walls, apertures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; disabled; plug-in component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
modeltoosm = HBModelToOSM(model=model.model, epw_file=downloadepw.epw_file, sim_par=simpar, write=toggle_2, run=toggle_2)  # -> report, jsons, osw, osm, idf, sql, zsz, rdd, html; disabled; plug-in component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

# ----
# Visualize Results
roomenergyresult = HBReadRoomEnergyResult(sql=modeltoosm.sql)  # -> cooling, heating, lighting, electric_equip, gas_equip, fan_electric, pump_electric, people_gain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; disabled; plug-in component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
hourlyplot = LBHourlyPlot(data=[roomenergyresult.cooling, roomenergyresult.heating, roomenergyresult.fan_electric, roomenergyresult.pump_electric])  # -> report, mesh, legend, borders, labels, title; disabled; plug-in component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

# ----
# Optionally Execute Simulations in Parallel
data = Data(modeltoosm.osw)  # disabled
data_2 = Data(modeltoosm.idf)  # disabled
data_3 = Data(downloadepw.epw_file)  # disabled
rec = DataRecorder(data, DataLimit=-10, RecordData=True)  # disabled
rec_2 = DataRecorder(data_2, DataLimit=-10, RecordData=True)  # disabled
toggle_3 = BooleanToggle(False)  # disabled
toggle_4 = BooleanToggle(False)  # disabled
toggle_5 = BooleanToggle(True)  # disabled
toggle_6 = BooleanToggle(True)  # disabled
runidf = HBRunIDF(idf=rec_2, epw_file=data_3, parallel=toggle_5, run=toggle_4)  # -> report, sql, zsz, rdd, html; disabled; plug-in component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
runosw = HBRunOSW(osw=rec, epw_file=data_3, parallel=toggle_6, translate=toggle_3, run=toggle_3)  # -> report, osm, idf, sql, zsz, rdd, html; disabled; plug-in component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

honeybee = Honeybee_Honeybee()  # -> Vviiiiiiiiiizzz; plug-in component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
ladybug = Ladybug_Ladybug()  # -> Vviiiiiiiiiizzz; plug-in component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
idf2phpp = BT_CORE()  # -> out; plug-in component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
new_phpp_frame = LBT2PH_CreatePHPPwindowFrame(name="gh_scene_frame")  # -> out, PHPPFrame; inputs frameWidths: list, frameUvalues: list, psiGlazings: list, psiInstalls: list; plug-in component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
new_phpp_glazing = LBT2PH_CreatePHPPwindowGlazing(name="gh_scene_glass")  # -> out, PHPPGlazing; plug-in component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
panel_11 = Panel(new_phpp_glazing.PHPPGlazing)
panel_12 = Panel(new_phpp_frame.PHPPFrame)
geo_3 = Geometry([<brep referenced from the Rhino model> x6])
get_surface_params = LBT2PH_GetSrfcParams(srfcs=geo_3, auto_orientation=Toggle(False))  # -> out, geo, name, type, bc, ep_const, rad_mod; inputs srfcs: list of Guid; plug-in component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
geo_4 = Geometry([<brep referenced from the Rhino model> x2])
panel_13 = Panel("12")
crv_duct = Curve(<curve referenced from the Rhino model>)
aperture = HBAperture(geo=geo_4)  # -> report, apertures; plug-in component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
# Aperture is not serializable!?!?
# What happened?
face_3 = HBFace(
    geo=get_surface_params.geo,
    name=get_surface_params.name,
    type=get_surface_params.type,
    bc=get_surface_params.bc,
    ep_constr=get_surface_params.ep_const)  # -> report, faces; plug-in component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
vent_duct = BT_CreateNewPHPPVentDuct(ductLength=flatten(crv_duct))  # -> out, hrvDuct; inputs ductLength: list, ductWidth: list, insulThickness: list, insulConductivity: list; plug-in component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
exhaust_vent = BT_CreateNewPHPPExhaustVentilator(name="Another One")  # -> out, exhaustVent; plug-in component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
exhaust_vent_2 = BT_CreateNewPHPPExhaustVentilator(name="My Test Unit")  # -> out, exhaustVent; plug-in component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
ventilator = BT_CreateNewPHPPVentUnit(name="My_Example_Unit")  # -> out, ventUnit; plug-in component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
phpp_aperture = LBT2PH_CreatePHPPAperture(apertures=aperture.apertures)  # -> out, apertures; inputs apertures: list, frames: list, glazings: list, psi_installs: list, installs: list; plug-in component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
room_2 = HBRoom(faces=flatten(face_3.faces), name="Garage", conditioned=True)  # -> report, room; plug-in component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
phpp_vent_sched = BT_CreateRoomVentSched(fanSpeed_high="1", fanSpeed_med=".5", fanSpeed_low="0.2")  # -> out, phpp_ventilation_sched; plug-in component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
# Spaces need to calculate
# - create default room if no tfa surface input
# - set vent flow rates
# 
# move custom vent 'set' ont this compo?
addsubface = HBAddSubface(hb_obj=flatten(room_2.room), sub_faces=flatten(phpp_aperture.apertures))  # -> hb_obj; plug-in component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
create_vent_system = BT_CreateNewPHPPVentSystem(
    vent_system_name="My_Vent_System",
    vent_unit=ventilator.ventUnit,
    hrvDuct_02=vent_duct.hrvDuct,
    exhaust_vent_units=[exhaust_vent_2.exhaustVent, exhaust_vent.exhaustVent])  # -> out, vent_system; inputs hrvDuct_01: list, hrvDuct_02: list, exhaust_vent_units: list; plug-in component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
brep_tfa_surfaces = Brep([<brep referenced from the Rhino model> x5])
brep = Brep(<brep referenced from the Rhino model>)
list = ValueList({"EP", "UD"}, selected="UD")
phpp_spaces = BT_PHPProomsFromRH(
    TFA_surfaces=flatten(brep_tfa_surfaces),
    HB_rooms=addsubface,
    vent_flowrate_source=list,
    phpp_vent_schedule=phpp_vent_sched.phpp_ventilation_sched)  # -> out, space_breps, phpp_spaces, HB_rooms; inputs TFA_surfaces: list of Guid, spaces_geometry: list of Guid, HB_rooms: list
#   port TFA_surfaces: (List) An input for the user-determined room floor area(s) to use. Supply inputs as surfaces. Use the Rhino tools to apply TFA information (TFA Factor, Roomname, etc..) in the Rhino scene before passing in here. Will bundle together rooms with the same number+name and will try and join together tfa surfaces that touch (if they have the same number+name).
# ---------- phpp_spaces: Python ----------
import rhinoscriptsyntax as rs
import Rhino
import ghpythonlib.components as ghc
import Grasshopper.Kernel as ghK
from copy import deepcopy

import LBT2PH
import LBT2PH.helpers
import LBT2PH.spaces
import LBT2PH.ventilation

reload(LBT2PH)
reload(LBT2PH.helpers)
reload(LBT2PH.spaces)
reload(LBT2PH.ventilation)

#
# Make it so you can pass in either Rhino geom (Guid) or GH generated Geometry
#
# ------------------------------------------------------------------------------
# Get the UD Space Geometry
with LBT2PH.helpers.context_rh_doc(ghdoc):
    space_geom = [rs.coercebrep(guid) for guid in _spaces_geometry]
    rhino_tfa_objects = [LBT2PH.spaces.get_tfa_surface_data_from_Rhino(guid) for guid in _TFA_surfaces]

HB_rooms_ = []
if _HB_rooms:
    tfa_objs = {}
    for tfa_srfc_geom, tfa_srfc_name, tfa_srfc_params in rhino_tfa_objects:
        # ----------------------------------------------------------------------
        # Find the TFA's host Room/Zone
        host_room = LBT2PH.spaces.find_tfa_host_room(tfa_srfc_geom, _HB_rooms)
        tfa_obj = LBT2PH.spaces.TFA_Surface(tfa_srfc_geom, host_room, tfa_srfc_params)
        if host_room is None: LBT2PH.spaces.display_host_error(tfa_obj, ghenv)
        
        
        # ----------------------------------------------------------------------
        # Add the new TFA Object to the master dict
        tfa_dict_key = tfa_obj.dict_key
        
        d = { tfa_obj.id : tfa_obj }
        if tfa_dict_key in tfa_objs: tfa_objs[tfa_dict_key].update(d)
        else: tfa_objs[tfa_dict_key] = d


# ------------------------------------------------------------------------------
# Find all the 'touching' TFA surfaces, organize by 'neighbor' into groups
for tfa_obj_list in tfa_objs.values():
    LBT2PH.spaces.find_neighbors( tfa_obj_list )

tfa_srfcs_grouped_by_neighbor = LBT2PH.spaces.bin_tfa_srfcs_by_neighbor(tfa_objs)
tfa_srfcs_cleaned = LBT2PH.spaces.join_touching_tfa_groups(tfa_srfcs_grouped_by_neighbor, ghenv)

# ------------------------------------------------------------------------------
# Build the Spaces for each tfa surface
phpp_spaces_dict = {}
for tfa_srfc in tfa_srfcs_cleaned:
    # See if you can make a closed space Brep
    # If you can, create a new Room Volume from the closed Brep set
    # Then remove that Room's Geom from the set to test (to speed future search?)
    # If no closables match found, create a default space volume
    # If no space geom input, just build a default size space for each
    
    
    # --------------------------------------------------------------------------
    if _spaces_geometry:
        for i, space_geometry in enumerate(space_geom):
            joined_vol = ghc.BrepJoin([space_geometry, tfa_srfc.surface])
            if joined_vol.closed is True:
                new_space_vol = LBT2PH.spaces.Volume( tfa_srfc, joined_vol )
                _spaces_geometry.pop(i)
                break
        else:
            msg = 'Could not join {} with any space geometry.'.format(tfa_srfc.dict_key)
            ghenv.Component.AddRuntimeMessage(ghK.GH_RuntimeMessageLevel.Remark, msg)
            new_space_vol = LBT2PH.spaces.Volume( tfa_srfc )
    else:
        new_space_vol = LBT2PH.spaces.Volume( tfa_srfc )
    
    
    # --------------------------------------------------------------------------
    # Sort the new Space Volume into the master Dict based on name
    if new_space_vol.dict_key in phpp_spaces_dict.keys():
        phpp_spaces_dict[new_space_vol.dict_key].append( new_space_vol )
    else:
        phpp_spaces_dict[new_space_vol.dict_key] = [ new_space_vol ]


#-------------------------------------------------------------------------------
# Build the final PHPP-Spaces from all the the Space Volume Objects
phpp_spaces_ = []

for space_volumes in phpp_spaces_dict.values():
    # Create a single new Room from the list of Room Volumes
    new_space_obj = LBT2PH.spaces.Space( space_volumes )
    phpp_spaces_.append( new_space_obj )



#-------------------------------------------------------------------------------
# Set each Space's fresh-air ventilation flow rates
if 'UD' in str(vent_flowrate_source_).upper(): type = 'UD'
else: type = 'EP'
for hb_room in _HB_rooms:
    # 1)  Figure out the Zone's Annual Average Ventilation Flow Rate
    #     (People + Area) based on HB Program (Load / Schedule)
    #
    # 2) Set the individual PHPP-Space Flow Rates based on the HB Program, or from Rhino Scene
    #
    # 3) If no UD schedule, Calculate the HB/EP Room Flow rates based on the PHPP-Rooms
    
    hb_room_avg_vent_rate = LBT2PH.ventilation.calc_hb_room_annual_vent_flow_rate(hb_room, ghenv)
    hb_room_tfa = sum([space.space_tfa for space in phpp_spaces_ if space.host_room_name == hb_room.display_name])
    
    for space in phpp_spaces_:
        space_vent_flow_rates = LBT2PH.ventilation.calc_space_vent_flow_rates(space, hb_room, hb_room_tfa, hb_room_avg_vent_rate, type, ghenv)
        if space_vent_flow_rates:
            space.set_phpp_vent_rates( space_vent_flow_rates )
        
        if phpp_vent_schedule_:
            space.vent_sched = phpp_vent_schedule_
        else:
            space.vent_sched = LBT2PH.ventilation.calc_space_vent_schedule(space, hb_room, hb_room_tfa)



#-------------------------------------------------------------------------------
# Pack the new space data into the HB Room/Zone object's user_data
HB_rooms_ = []
space_breps_ = []
for hb_room in _HB_rooms:
    # Initialize the new param dict
    user_data = {}
    user_data['phpp'] = {}
    user_data['phpp']['vent_system'] = {}
    user_data['phpp']['spaces'] = {}
    
    
    #---------------------------------------------------------------------------
    # Build a default ventilation system, apply it to the HB Room
    # Add the vent system data to the user_data
    default_ventilation_system = LBT2PH.ventilation.PHPP_Sys_Ventilation(_ghenv=ghenv, _system_id='default')
    user_data['phpp']['vent_system'] = default_ventilation_system.to_dict()
    
    
    #---------------------------------------------------------------------------
    # Add the new PHPP Spaces onto the HB Room
    for phpp_space in phpp_spaces_:
        if hb_room.display_name == phpp_space.host_room_name:
            key = '{}_{}'.format(phpp_space.dict_key, phpp_space.id)
            space = { key : phpp_space.to_dict() }
            user_data['phpp']['spaces'].update( space )
        
        # Grab the brep for preview as well
        space_breps_.extend(phpp_space.space_breps)
    
    
    #---------------------------------------------------------------------------
    # Set the user_data dict on the Honeybee Room with all the new param info
    new_hb_room = hb_room.duplicate()
    new_hb_room.user_data = user_data
    
    HB_rooms_.append(new_hb_room)
# ---------- end phpp_spaces ----------
brep_2 = Brep(phpp_spaces.space_breps)
set_zone_vent = BT_SetZoneVentSystem(vent_system=create_vent_system.vent_system, HB_rooms=flatten(phpp_spaces.HB_rooms))  # -> out, HB_rooms; inputs HB_rooms: list; plug-in component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
airtightness = BT_Airtightness(HB_rooms=flatten(set_zone_vent.HB_rooms), n50="1.15", blower_pressure="50")  # -> out, HB_rooms; inputs HB_rooms: list; plug-in component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
# Double check the Reveal dims.. divid by 2?
create_window_reveals = BT_CreateWindowReveals(HB_rooms=flatten(airtightness.HB_rooms))  # -> out, HB_rooms, window_surrounds, envelope_surfaces, port, window_names, window_surfaces, envelope_surfaces_punched; inputs HB_rooms: list; plug-in component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
shading_factors_simple = BT_CalcWindowShadingFactors_Simple(
    runIt=Toggle(True),
    latitude="40",
    HB_rooms=create_window_reveals.HB_rooms,
    window_surrounds=simplify(create_window_reveals.window_surrounds),
    envelope_surfaces=simplify(flatten(create_window_reveals.envelope_surfaces)))  # -> out, HB_rooms, checklines; inputs HB_rooms: list, window_surrounds: tree, envelope_surfaces: list, shading_surfaces: list; plug-in component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
panel_14 = Panel("""0.67
0.54""")
panel_15 = Panel("""0.3
0.4""")
line = Line(shading_factors_simple.checklines)
apply_win_shading_factors = BT_ApplyWindowShadingFactors(
    HB_rooms=shading_factors_simple.HB_rooms,
    window_names=create_window_reveals.window_names,
    winter_shading_factors=panel_14,
    summer_shading_factors=panel_15)  # -> out, HB_rooms; inputs HB_rooms: list, window_names: list, winter_shading_factors: list, summer_shading_factors: list; plug-in component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
panel_16 = Panel("12.0")
srf = Surface(<surface referenced from the Rhino model>)
# - Figure out if its adding the banks together right
# - Add support for exterior piping
geo_5 = Geometry([<curve referenced from the Rhino model> x3])
crv = Curve(<curve referenced from the Rhino model>)
crv_2 = Curve([<curve referenced from the Rhino model> x3])
list_2 = ValueList({"1", "2"}, selected="1")
piping_recirc = BT_DHW_Piping_Recirc(pipe_geom=crv)  # -> out, circulation_piping; inputs pipe_geom: list, pipe_diam: list, insulThickness: list, insulConductivity: list, insulReflective: list of Boolean; plug-in component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
list_3 = ValueList({"1", "2", "3", "4"}, selected="1")
srf_2 = Surface(<surface referenced from the Rhino model>)
dhw_usage = BT_DHW_Usage(useType=list_2, showers_demand="45")  # -> out, usage; plug-in component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
dhw_tank = BT_DHW_Tank(tank_type="1", tank_HLrate="12", tank_volume="12")  # -> out, storage_tank; inputs tank_solar: Boolean; plug-in component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
piping_branches = BT_DHW_Piping_Banches(pipe_geom=crv_2)  # -> out, branch_piping; inputs pipe_geom: list; plug-in component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
create_floor_element = BT_GroundContactElement(HB_rooms=apply_win_shading_factors.HB_rooms, type=list_3)  # -> out, ground_elements, HB_rooms; inputs HB_rooms: list, floor_surfaces: list, exposedPerimCrvs: list; plug-in component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
panel_18 = Panel(create_floor_element.ground_elements)
dhw = BT_DHW_System(
    HB_rooms=create_floor_element.HB_rooms,
    usage=dhw_usage.usage,
    circulation_piping=piping_recirc.circulation_piping,
    branch_piping=piping_branches.branch_piping,
    tank1=dhw_tank.storage_tank,
    tank2=dhw_tank.storage_tank)  # -> out, dhw, HB_rooms; inputs HB_rooms: list, circulation_piping: list, branch_piping: list; plug-in component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
# Add a Summer Vent component
panel_19 = Panel(dhw.HB_rooms)
range = Range(Domain=Domain(0, 1), Steps="14")
panel_20 = Panel("""-15.0	38.6	4.90	2.11
-5.0	44.0	5.34	2.41
0.0	54.3	5.42	2.54
-4.9	19.6	5.49	2.78
-1.3	22.3	6.26	2.96
-15.0	35.7	2.45	1.71
-5.0	40.9	2.67	1.88
0.0	51.1	2.71	1.70
0.0	16.3	2.75	4.49
4.4	18.6	3.13	5.10""")
panel_21 = Panel(range)
list_4 = ValueList({"1-Outdoor air", "2-Ground water", "3-Ground probes", "4-Horizontal ground collector"}, selected="2-Ground water")
# Figure out how to have this
# set the PHPP AND the E+ values
pnll_resi_loads_schedules = BT_PNLL_Resi_Loads()  # -> out, HBZones, port, PNNL_ElecEquip_Load, PNNL_Lighting_Load, PNNL_Occup_Load, port_2, PNNL_SF_Occup_Sched, PNNL_SF_Lighting_Sched, PNNL_ElecEquip_Sched; inputs HBZones: list; plug-in component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
list_5 = ValueList({"1-Underfloor heating", "2-Radiators", "3-Supply air heating"}, selected="2-Radiators")
phpp_res_appliances = BT_SetResAppliances(HB_rooms=dhw.HB_rooms, use_resi_defaults=Toggle(True), avg_lighting_efficacy="56")  # -> out, HB_rooms; inputs HB_rooms: list, other: list; plug-in component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
set_hb_to_phpp_resi_loads = BT_SetPHPPResLoads(HB_rooms=simplify(flatten(phpp_res_appliances.HB_rooms)))  # -> out, HB_rooms, port, PHPP_equipmentLoadPerArea, PHPP_lightingDensityPerArea, PHPP_numOfPeoplePerArea, port_2, PHPP_occupancySchedule, PHPP_lightingSchedule, PHPP_epuipmentSchedule; inputs HB_rooms: list, num_res_units: Int32; plug-in component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
cooling_recirc = BT_CreateCooling_Recirc(on_off_mode=Toggle(True))  # -> out, recirc_air_cooling; inputs on_off_mode: Boolean, variable_vol: Boolean; disabled; plug-in component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
cooling_dehumid = BT_CreateCooling_Dehumidification(waste_heat_to_room=Toggle(True))  # -> out, dehumid_cooling; inputs waste_heat_to_room: Boolean; disabled; plug-in component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
heating_hp_options = BT_Heating_ASHP_Options(design_forward_water_temp="33.3", hp_distribution=list_5)  # -> out, hp_options; disabled; plug-in component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
cooling_sup_air = BT_CreateCooling_SupplyAir(on_off_mode=Toggle(True))  # -> out, supply_air_cooling; inputs on_off_mode: Boolean; disabled; plug-in component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
heating_hp = BT_Heating_ASHP(source=list_4)  # -> out, heat_pump; inputs fromPHPP: list, temps_source: list, temps_sink: list, heating_capacities: list, COPs: list; disabled; plug-in component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
cooling_panel = BT_CreateCooling_Panel(SEER="45")  # -> out, panel_cooling; disabled; plug-in component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
summervent = GhPythonScript(HB_rooms=set_hb_to_phpp_resi_loads.HB_rooms, use_default=Toggle(True))  # -> out, HB_room; inputs HB_rooms: list, use_default: Boolean
# ---------- summervent: Python ----------
import LBT2PH
import LBT2PH.summer_vent
import LBT2PH.helpers

reload(LBT2PH)
reload(LBT2PH.summer_vent)
reload(LBT2PH.helpers)

#-------------------------------------------------------------------------------
# Build the Summ-Vent Object
summ_vent_obj = LBT2PH.summer_vent.PHPP_SummVent()
if use_default_:
    summ_vent_obj.day_ach = 'L20*0.5'
    summ_vent_obj.night_ach = 'L31'

if basic_ach_: summ_vent_obj.day_ach = basic_ach_
if nighttime_ach: summ_vent_obj.night_ach = nighttime_ach

#-------------------------------------------------------------------------------
# Add the Summ-Vent objects onto the Honeybee Rooms
HB_room_ = []
output_dict = {summ_vent_obj.id:summ_vent_obj.to_dict() }
for hb_room in _HB_rooms:
    new_room = hb_room.duplicate()
    new_room = LBT2PH.helpers.add_to_HB_model(hb_room, 'summ_vent', output_dict, ghenv, 'overwrite' )
    
    HB_room_.append( new_room )
# ---------- end summervent ----------
toggle_7 = BooleanToggle(True)  # disabled
panel_22 = Panel("12")  # disabled
list_6 = ValueList({"1", "2", "3", "4", "5", "6"}, selected="1")  # disabled
heating_cooling_systems = BT_SetSystems(
    HB_rooms=summervent.HB_room,
    primary_heat_generation=list_6,
    heating_frac_primary=panel_22,
    hp_heating=heating_hp.heat_pump,
    hp_options=heating_hp_options.hp_options)  # -> out, HB_rooms; inputs HB_rooms: list, mech_cooling: Boolean; disabled; plug-in component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
python = GhPythonScript(x=heating_cooling_systems.HB_rooms)  # -> out, a
# ---------- python: Python ----------
import json
#for space in x.user_data['phpp']['spaces'].values():
    #print space['vent_sched']
print json.dumps(x.user_data['phpp']['PER'], indent=2)

print json.dumps(x.user_data['phpp']['heating_cooling'], indent=2)
# ---------- end python ----------

# ----
# Download EPW File
panel_23 = Panel("https://www.energyplus.net/weather-download/north_and_central_america_wmo_region_4/USA/MA/USA_MA_Boston-Logan.Intl.AP.725090_TMY3/all")
downloadepw_2 = LBDownloadWeather(weather_URL=panel_23)  # -> epw_file, stat_file, ddy_file; plug-in component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

model_2 = HBModel(rooms=flatten(heating_cooling_systems.HB_rooms), name="Test Model")  # -> report, model; plug-in component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
vizbytype_2 = HBVisualizeByType(rooms=model_2.model)  # -> walls, interior_walls, roofs, ceilings, exterior_floors, interior_floors, air_walls, apertures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; plug-in component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
panel_24 = Panel(python.out)
panel_25 = Panel("""12
14
25""")
crv_3 = Curve([<curve referenced from the Rhino model> x2])
thermal_bridges = BT_SetTB(model=model_2.model, estimated_tb="12", linear_tb_lengths=crv_3, point_tb_ChiValues=panel_25)  # -> out, HB_model; inputs linear_tb_lengths: list, linear_tb_psi_values: list, linear_tb_fRsi_values: list, point_tb_Names: list, point_tb_ChiValues: list, point_tb_fRsi_values: list; disabled; plug-in component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
phpp_setup = BT_SetPHPPSetup(HB_model=thermal_bridges.HB_model)  # -> out, HB_model; disabled; plug-in component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
lbt_phpp = LBT2PH_ConvertLBT2PHPPObjs(epw_file=downloadepw_2.epw_file, model=phpp_setup.HB_model)  # -> out, footprint, excel_objects; inputs rooms_included: list, rooms_excluded: list, ud_row_starts: list; disabled; plug-in component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
# Mech Cooling Yes | No somehow...
panel_26 = Panel(lbt_phpp.excel_objects)
branch = TreeBranch(Tree=lbt_phpp.excel_objects, Path="{19}", MaintainPaths=True)
branch_2 = TreeBranch(Tree=lbt_phpp.excel_objects, Path="{20}", MaintainPaths=True)
panel_27 = Panel(branch_2)
panel_28 = Panel(branch)
open_xl_workbook = BT_XLOpenWorkbook(
    run=Toggle(False),
    oldFilename="C:\LBT2PH_Testing\_source.xlsx",
    newDirectory="C:\LBT2PH_Testing\",
    newFilename="Output_01")  # -> excel; disabled; plug-in component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
write_xl_workbook = BT_XLWriteWorkbook(excel=open_xl_workbook)  # -> excel, numWrites; inputs XL_Objects: tree; disabled; plug-in component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
panel_29 = Panel(write_xl_workbook.numWrites)
