# Grasshopper definition 201125_LBT_Testing.gh (Grasshopper 1.0.7)
# plug-ins: Human

honeybee = Honeybee_Honeybee()  # -> Vviiiiiiiiiizzz; plug-in component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
ladybug = Ladybug_Ladybug()  # -> Vviiiiiiiiiizzz; plug-in component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
create_py_from_ghuser = __LBT__Util_CreatePYfromGHUSER(runIt=Toggle(False), all=False, saveDirectory=False)  # -> out, a; inputs runIt: Boolean, all: Boolean
# ---------- create_py_from_ghuser: Python ----------
"""
Will grab all the 'LBT2_' ghuser components, add them to the scene, write their code to disk, then remove them from the scene.
-
EM November 21, 2020
    Args:
        _runIt:
        all_: (bool) Default=False. If TRUE, will write ALL the BT objs. If False, will only write the ones found on the active GH Canvas.
        _ghUserDirectory: <Optional> Default = C:\Users\edpma\AppData\Roaming\Grasshopper\UserObjects\
        _saveDirectory: <Optional> Default = \\Mac\Home\Dropbox\bldgtyp-00\00_PHPP\00_IDF2PH\01_GH_Components\  (will add ..\py\.. and ..\ghuser\.. subdirs for files)
   Returns:
"""

ghenv.Component.Name = "__LBT__Util_CreatePYfromGHUSER"
ghenv.Component.NickName = "Create PY from GHUSER"
ghenv.Component.Message = 'NOV_21_2020'
ghenv.Component.IconDisplayMode = ghenv.Component.IconDisplayMode.application
ghenv.Component.Category = "PH-Tools"
ghenv.Component.SubCategory = "00 | Utils"

import os
import Grasshopper.Kernel as ghK
import shutil

def writeComponentsAsPY():
    """ Finds all compos in the scene, writes their code to a folder"""
    
    doc = ghenv.Component.OnPingDocument()
    objs = list(doc.Objects)
    
    for obj in objs:
        if obj.Category != 'PH-Tools':
            continue
        
        if 'LBT' in obj.Name[:4]:
            address = saveDir + obj.Name + '.py'
            
            if os.path.exists(address):
                os.remove(address)
            
            componentCode = obj.Code.split("\n")
            with open(address, 'wb') as f:
                for line in componentCode:
                    f.write(line.replace('\r', '\n'))

def copyGHuserFile():
    doc = ghenv.Component.OnPingDocument()
    objs = list(doc.Objects)
    
    for obj in objs:
        if obj.Category != 'PH-Tools':
            continue
        
        if 'LBT' in obj.Name[:4]:
            srcAddress = ghuserDir + obj.Name + '.ghuser'
            saveAddress = saveDir_ghUser + obj.Name + '.ghuser'
            
            if os.path.exists(srcAddress):
                shutil.copy(srcAddress, saveAddress)

def writeALLtoDisk():
    if not os.path.exists(ghuserDir):
        print('GHUser Directory not found?')
    else:
        ghuserFileNames = os.listdir(ghuserDir)
        for eachCompoName in ghuserFileNames:
            if 'LBT' in eachCompoName:
                compo = ghK.GH_UserObject(ghuserDir+eachCompoName).InstantiateObject()
                ghdoc = ghenv.Component.OnPingDocument()
                ghdoc.AddObject(compo, False)
                
                writeComponentsAsPY()
                copyGHuserFile()
                
                ghdoc.RemoveObject(compo, False)

def writeCanvasCompoToDisk():
    if not os.path.exists(ghuserDir):
        print('GHUser Directory not found?')
    else:
        writeComponentsAsPY()
        copyGHuserFile()

def copy_scripts(_source_dir, _target_dir):
    print 'copying scripts'
    print _source_dir
    print _target_dir
    
    source_files = os.listdir(_source_dir)
    for file_name in source_files:
        full_file_name = os.path.join( _source_dir, file_name )
        if os.path.isfile(full_file_name):
            shutil.copy( full_file_name, _target_dir )

ghuserDir = r"C:\Users\edpma\AppData\Roaming\Grasshopper\UserObjects"'\\'
rh_scripts_dir = r"C:\Users\edpma\AppData\Roaming\McNeel\Rhinoceros\6.0\scripts\LBT2PH"'\\'

saveDir = str(r"\\Mac\Home\Dropbox\bldgtyp-00\00_PH_Tools\LBT2PH\ghuser_py"'\\')
saveDir_ghUser = str(r"\\Mac\Home\Dropbox\bldgtyp-00\00_PH_Tools\LBT2PH\ghuser"'\\')
saveDir_rh_scripts = str(r"\\Mac\Home\Dropbox\bldgtyp-00\00_PH_Tools\LBT2PH\scripts\LBT2PH"'\\')

if _saveDirectory:
    saveDir = _saveDirectory + "\py"'\\'

if _saveDirectory:
    saveDir_ghUser = _saveDirectory + "\ghuser"'\\'

if _ghUserDirectory:
    ghuserDir = _ghUserDirectory

if not os.path.exists(saveDir):
    try:
        os.mkdir(saveDir)
    except:
        saveDir = False
        print('Please provide a valid save directory. Maybe try adding/removing the backslash to the end?')

if _runIt and saveDir and all_:
    writeALLtoDisk()

if _runIt and saveDir and not all_:
    writeCanvasCompoToDisk()

if _runIt and saveDir_rh_scripts and rh_scripts_dir:
    copy_scripts(rh_scripts_dir, saveDir_rh_scripts)
# ---------- end create_py_from_ghuser ----------
new_phpp_frame = LBT2PH_CreatePHPPwindowFrame(name="gh_scene_frame")  # -> out, PHPPFrame; inputs frameWidths: list, frameUvalues: list, psiGlazings: list, psiInstalls: list; plug-in component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
new_phpp_glazing = LBT2PH_CreatePHPPwindowGlazing(name="gh_scene_glass")  # -> out, PHPPGlazing; plug-in component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
idf2phpp = BT_CORE()  # -> out; plug-in component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
panel = Panel(new_phpp_glazing.PHPPGlazing)
panel_2 = Panel(new_phpp_frame.PHPPFrame)
geo = Geometry([<brep referenced from the Rhino model> x6])
get_surface_params = LBT2PH_GetSrfcParams(srfcs=geo, auto_orientation=Toggle(False))  # -> out, geo, name, type, bc, ep_const, rad_mod; inputs srfcs: list of Guid; plug-in component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
panel_3 = Panel("12")
geo_2 = Geometry([<brep referenced from the Rhino model> x2])
crv_duct = Curve(<curve referenced from the Rhino model>)
aperture = HBAperture(geo=geo_2)  # -> report, apertures; plug-in component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
face = HBFace(
    geo=get_surface_params.geo,
    name=get_surface_params.name,
    type=get_surface_params.type,
    bc=get_surface_params.bc,
    ep_constr=get_surface_params.ep_const)  # -> report, faces; plug-in component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
vent_duct = LBT2PH_CreateNewPHPPVentDuct(ductLength=flatten(crv_duct))  # -> out, hrvDuct; inputs ductLength: list, ductWidth: list, insulThickness: list, insulConductivity: list; plug-in component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
exhaust_vent = LBT2PH_CreateNewPHPPExhaustVentilator(name="Another One")  # -> out, exhaustVent; plug-in component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
exhaust_vent_2 = LBT2PH_CreateNewPHPPExhaustVentilator(name="My Test Unit")  # -> out, exhaustVent; plug-in component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
ventilator = LBT2PH_CreateNewPHPPVentUnit(name="My_Example_Unit")  # -> out, ventUnit; plug-in component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
bldgprograms = HBBuildingPrograms({"LargeOffice", "MediumOffice", "SmallOffice", "MidriseApartment", "HighriseApartment", "Retail", "StripMall", "PrimarySchool", "SecondarySchool", "SmallHotel", "LargeHotel", "Hospital", "Outpatient", "Laboratory", "Warehouse", "SuperMarket", "FullServiceRestaurant", "QuickServiceRestaurant", "Courthouse", "LargeDataCenterHighITE", "LargeDataCenterLowITE", "SmallDataCenterHighITE", "SmallDataCenterLowITE"}, selected="MidriseApartment")
phpp_aperture = LBT2PH_CreatePHPPAperture(apertures=aperture.apertures)  # -> out, apertures; inputs apertures: list, frames: list, glazings: list, psi_installs: list, installs: list; plug-in component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
searchprog = HBSearchPrograms(bldg_prog=bldgprograms)  # -> room_prog; plug-in component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
list = ItemSelector(
    searchprog,
    {"2013::MidriseApartment::Apartment", "2013::MidriseApartment::Corridor", "2013::MidriseApartment::Office"}, selected="2013::MidriseApartment::Apartment")
room = HBRoom(faces=flatten(face.faces), name="Garage", program=list, conditioned=True)  # -> report, room; plug-in component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
phpp_vent_sched = LBT2PH_CreateRoomVentSched(fanSpeed_high="1", fanSpeed_med=".5", fanSpeed_low="0.2")  # -> out, phpp_ventilation_sched; plug-in component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
panel_4 = Panel("Test Model")  # disabled
model = HBModel(rooms=flatten(room.room), name=panel_4)  # -> report, model; disabled; plug-in component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
addsubface = HBAddSubface(hb_obj=flatten(room.room), sub_faces=flatten(phpp_aperture.apertures))  # -> hb_obj; plug-in component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
create_vent_system = LBT2PH_CreateNewPHPPVentSystem(
    vent_system_name="My_Vent_System",
    vent_unit=ventilator.ventUnit,
    hrvDuct_02=vent_duct.hrvDuct,
    exhaust_vent_units=[exhaust_vent_2.exhaustVent, exhaust_vent.exhaustVent])  # -> out, vent_system; inputs hrvDuct_01: list, hrvDuct_02: list, exhaust_vent_units: list; plug-in component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
toggle = BooleanToggle(True)  # disabled
brep_tfa_surfaces = Brep([<brep referenced from the Rhino model> x5])
panel_5 = Panel("C:\Example")  # disabled
brep = Brep(<brep referenced from the Rhino model>)

# ----
# Download EPW File
panel_6 = Panel("https://www.energyplus.net/weather-download/north_and_central_america_wmo_region_4/USA/MA/USA_MA_Boston-Logan.Intl.AP.725090_TMY3/all")  # disabled
downloadepw = LBDownloadWeather(weather_URL=panel_6)  # -> epw_file, stat_file, ddy_file; disabled; plug-in component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

list_2 = ValueList({"EP", "UD"}, selected="UD")
panel_7 = Panel("2")  # disabled
# Spaces need to calculate
# - create default room if no tfa surface input
phpp_spaces = LBT2PH_CreatePHPPSpaces(
    HB_rooms=addsubface,
    set_honeybee_loads=Toggle(False),
    TFA_surfaces=flatten(brep_tfa_surfaces),
    spaces_geometry=flatten(brep),
    vent_flowrate_source=list_2,
    phpp_vent_schedule=phpp_vent_sched.phpp_ventilation_sched)  # -> out, space_breps, phpp_spaces, HB_rooms; inputs HB_rooms: list, set_honeybee_loads: Boolean, TFA_surfaces: list, spaces_geometry: list of Guid; plug-in component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
modeltoosm = HBModelToOSM(model=model.model, epw_file=downloadepw.epw_file, folder=panel_5, write=toggle, run=panel_7)  # -> report, jsons, osw, osm, idf, sql, zsz, rdd, html; disabled; plug-in component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
ventcontrol = HBVentilationControl()  # -> vent_cntrl; disabled; plug-in component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
panel_8 = Panel(modeltoosm.idf)  # disabled
brep_2 = Brep(phpp_spaces.space_breps)
roomenergyattr = HBRoomEnergyAttributes({"Program": "properties.energy.program_type.display_name", "Construction Set": "properties.energy.construction_set.display_name", "Is Conditioned": "properties.energy.is_conditioned", "People per Area [ppl/m2]": "properties.energy.people.people_per_area", "Area per Person [m2/ppl]": "properties.energy.people.area_per_person", "Lighting per Area [W/m2]": "properties.energy.lighting.watts_per_area", "Electric Equipment per Area [W/m2]": "properties.energy.electric_equipment.watts_per_area", "Gas Equipment per Area [W/m2]": "properties.energy.gas_equipment.watts_per_area", "Infiltration per Exterior Area [m3/s-m2]": "properties.energy.infiltration.flow_per_exterior_area", "Ventilation per Person [m3/s-ppl]": "properties.energy.ventilation.flow_per_person"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}, selected="Ventilation Schedule": "properties.energy.ventilation.schedule.display_name")
set_zone_vent = LBT2PH_SetZoneVentSystem(vent_system=create_vent_system.vent_system, HB_rooms=flatten(phpp_spaces.HB_rooms))  # -> out, HB_rooms; inputs HB_rooms: list; plug-in component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
labelrooms = HBLabelRooms(rooms_model=flatten(phpp_spaces.HB_rooms), attribute=roomenergyattr)  # -> label_text, base_pts, labels, wire_frame; plug-in component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
panel_9 = Panel(labelrooms.labels)
airtightness = LBT2PH_Airtightness(HB_rooms=flatten(set_zone_vent.HB_rooms), n50="1.15", blower_pressure="50")  # -> out, HB_rooms; inputs HB_rooms: list; plug-in component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
# Double check the Reveal dims.. divid by 2?
create_window_reveals = LBT2PH_CreateWindowReveals(HB_rooms=flatten(airtightness.HB_rooms))  # -> out, HB_rooms, window_surrounds, envelope_surfaces, port, window_names, window_surfaces, envelope_surfaces_punched; inputs HB_rooms: list; plug-in component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
searchschs = HBSearchSchedules(keywords=labelrooms.labels, join_words=Toggle(True))  # -> schedules, type_limits; plug-in component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
shading_factors_simple = LBT2PH_CalcWindowShadingFactors_Simple(
    runIt=Toggle(True),
    latitude="40",
    HB_rooms=create_window_reveals.HB_rooms,
    window_surrounds=simplify(create_window_reveals.window_surrounds),
    envelope_surfaces=simplify(flatten(create_window_reveals.envelope_surfaces)))  # -> out, HB_rooms, checklines; inputs HB_rooms: list, window_surrounds: tree, envelope_surfaces: list, shading_surfaces: list; plug-in component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
deconstrsch = HBDeconstructSchedule(schedule=searchschs.schedules)  # -> day_names, day_data, type_limit; plug-in component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
schtodata = HBScheduleToData(schedule=searchschs.schedules)  # -> data; plug-in component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
panel_10 = Panel("""0.67
0.54""")
panel_11 = Panel("""0.3
0.4""")
panel_12 = Panel(schtodata)
line = Line(shading_factors_simple.checklines)
apply_win_shading_factors = LBT2PH_ApplyWindowShadingFactors(
    HB_rooms=shading_factors_simple.HB_rooms,
    window_names=create_window_reveals.window_names,
    winter_shading_factors=panel_10,
    summer_shading_factors=panel_11)  # -> out, HB_rooms; inputs HB_rooms: list, window_names: list, winter_shading_factors: list, summer_shading_factors: list; plug-in component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
panel_13 = Panel("12.0")
srf = Surface(<surface referenced from the Rhino model>)
# - Figure out if its adding the banks together right
# - Add support for exterior piping
geo_3 = Geometry([<curve referenced from the Rhino model> x3])
crv = Curve(<curve referenced from the Rhino model>)
crv_2 = Curve([<curve referenced from the Rhino model> x3])
applyloadvals = HBApplyLoadValues()  # -> report, mod_obj; plug-in component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
list_3 = ValueList({"1", "2"}, selected="1")
piping_recirc = LBT2PH_DHW_Piping_Recirc(pipe_geom=crv)  # -> out, circulation_piping; inputs pipe_geom: list, pipe_diam: list, insulThickness: list, insulConductivity: list, insulReflective: list of Boolean; plug-in component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
list_4 = ValueList({"1", "2", "3", "4"}, selected="1")
srf_2 = Surface(<surface referenced from the Rhino model>)
dhw_usage = LBT2PH_DHW_Usage(useType=list_3, showers_demand="45")  # -> out, usage; plug-in component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
dhw_tank = LBT2PH_DHW_Tank(tank_type="1", tank_HLrate="12", tank_volume="12")  # -> out, storage_tank; inputs tank_solar: Boolean; plug-in component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
piping_branches = LBT2PH_DHW_Piping_Banches(pipe_geom=crv_2)  # -> out, branch_piping; inputs pipe_geom: list; plug-in component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
create_floor_element = LBT2PH_GroundContactElement(HB_rooms=apply_win_shading_factors.HB_rooms, type=list_4)  # -> out, ground_elements, HB_rooms; inputs HB_rooms: list, floor_surfaces: list, exposedPerimCrvs: list; plug-in component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
panel_15 = Panel(create_floor_element.ground_elements)
dhw = LBT2PH_DHW_System(
    HB_rooms=create_floor_element.HB_rooms,
    usage=dhw_usage.usage,
    circulation_piping=piping_recirc.circulation_piping,
    branch_piping=piping_branches.branch_piping,
    tank1=dhw_tank.storage_tank,
    tank2=dhw_tank.storage_tank)  # -> out, dhw, HB_rooms; inputs HB_rooms: list, circulation_piping: list, branch_piping: list; plug-in component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
panel_16 = Panel(dhw.HB_rooms)
range = Range(Domain=Domain(0, 1), Steps="14")
panel_17 = Panel("""-15.0	38.6	4.90	2.11
-5.0	44.0	5.34	2.41
0.0	54.3	5.42	2.54
-4.9	19.6	5.49	2.78
-1.3	22.3	6.26	2.96
-15.0	35.7	2.45	1.71
-5.0	40.9	2.67	1.88
0.0	51.1	2.71	1.70
0.0	16.3	2.75	4.49
4.4	18.6	3.13	5.10""")
list_5 = ValueList({"1-Outdoor air", "2-Ground water", "3-Ground probes", "4-Horizontal ground collector"}, selected="2-Ground water")
panel_18 = Panel(range)
list_6 = ValueList({"1-Underfloor heating", "2-Radiators", "3-Supply air heating"}, selected="2-Radiators")
pnll_resi_loads_schedules = LBT2PH_PNLL_Resi_Loads(HB_rooms=dhw.HB_rooms)  # -> out, HB_rooms, port, PNNL_ElecEquip_Load, PNNL_Lighting_Load, PNNL_Occup_Load, port_2, PNNL_SF_Occup_Sched, PNNL_SF_Lighting_Sched, PNNL_ElecEquip_Sched; inputs HB_rooms: list; plug-in component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
cooling_recirc = LBT2PH_CreateCooling_Recirc(on_off_mode=Toggle(True))  # -> out, recirc_air_cooling; inputs on_off_mode: Boolean, variable_vol: Boolean; plug-in component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
cooling_dehumid = LBT2PH_CreateCooling_Dehumidification(waste_heat_to_room=Toggle(True))  # -> out, dehumid_cooling; inputs waste_heat_to_room: Boolean; plug-in component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
heating_hp_options = LBT2PH_Heating_ASHP_Options(design_forward_water_temp="33.3", hp_distribution=list_6)  # -> out, hp_options; plug-in component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
cooling_sup_air = LBT2PH_CreateCooling_SupplyAir(on_off_mode=Toggle(True))  # -> out, supply_air_cooling; inputs on_off_mode: Boolean; plug-in component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
heating_hp = LBT2PH_Heating_ASHP(source=list_5)  # -> out, heat_pump; inputs fromPHPP: list, temps_source: list, temps_sink: list, heating_capacities: list, COPs: list; plug-in component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
cooling_panel = LBT2PH_CreateCooling_Panel(SEER="45")  # -> out, panel_cooling; plug-in component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
list_7 = ValueList({"1", "2", "3", "4", "5", "6"}, selected="5")
summervent = LBT2PH_SummerVentilation(HB_rooms=pnll_resi_loads_schedules.HB_rooms, use_default=Toggle(True))  # -> out, HB_rooms; inputs HB_rooms: list, use_default: Boolean; plug-in component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
list_8 = ValueList({"1", "2", "3", "4", "5", "6"}, selected="2")
heating_cooling_systems = LBT2PH_SetSystems(
    HB_rooms=summervent.HB_rooms,
    primary_heat_generation=list_7,
    secondary_heat_generation=list_8,
    mech_cooling=Toggle(True),
    hp_heating=heating_hp.heat_pump,
    hp_options=heating_hp_options.hp_options,
    recirc_air_cooling=cooling_recirc.recirc_air_cooling)  # -> out, HB_rooms; inputs HB_rooms: list, mech_cooling: Boolean; plug-in component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
python = GhPythonScript(x=heating_cooling_systems.HB_rooms)  # -> out, a
# ---------- python: Python ----------
import json
#for space in x.user_data['phpp']['spaces'].values():
    #print space['vent_sched']

print json.dumps(x.user_data['phpp'], indent=2)
# ---------- end python ----------

# ----
# Download EPW File
panel_20 = Panel("https://www.energyplus.net/weather-download/north_and_central_america_wmo_region_4/USA/MA/USA_MA_Boston-Logan.Intl.AP.725090_TMY3/all")
downloadepw_2 = LBDownloadWeather(weather_URL=panel_20)  # -> epw_file, stat_file, ddy_file; plug-in component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

model_2 = HBModel(rooms=flatten(heating_cooling_systems.HB_rooms), name="Test Model")  # -> report, model; plug-in component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
vizbytype = HBVisualizeByType(rooms=model_2.model)  # -> walls, interior_walls, roofs, ceilings, exterior_floors, interior_floors, air_walls, apertures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; plug-in component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
panel_21 = Panel(python.out)
panel_22 = Panel("""12
14
25""")
crv_3 = Curve([<curve referenced from the Rhino model> x2])
thermal_bridges = LBT2PH_SetTB(model=model_2.model, estimated_tb="12", linear_tb_lengths=crv_3, point_tb_ChiValues=panel_22)  # -> out, HB_model; inputs linear_tb_lengths: list, linear_tb_psi_values: list, linear_tb_fRsi_values: list, point_tb_Names: list, point_tb_ChiValues: list, point_tb_fRsi_values: list; plug-in component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
panel_24 = Panel("20")
list_9 = ValueList({"1", "2", "3", "4"}, selected="1")
phpp_occupancy = LBT2PH_SetPHPPOccupancy(HB_model=thermal_bridges.HB_model, set_honeybee_loads=Toggle(True), buildingType=list_9)  # -> out, occupancy_sch, ppl_per_area, HB_model; inputs set_honeybee_loads: Boolean; plug-in component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
panel_25 = Panel("""A Tst, 56
Another, 455""")
phpp_res_appliances = LBT2PH_SetResAppliances(HB_model=phpp_occupancy.HB_model, use_resi_defaults=Toggle(True), set_honeybee_loads=Toggle(True), other=panel_25)  # -> out, HB_model; inputs use_resi_defaults: Boolean, set_honeybee_loads: Boolean, other: list; plug-in component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
phpp_setup = LBT2PH_SetPHPPSetup(HB_model=phpp_res_appliances.HB_model)  # -> out, HB_model; plug-in component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
create_excel_obj_setup = BT_CreateXLObj_Setup()  # -> out, toPHPP_Setup; inputs Heating_Cooling: tree, summerVent: list; plug-in component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
lbt_phpp = LBT2PH_ConvertLBT2PHPPObjs(epw_file=downloadepw_2.epw_file, model=phpp_setup.HB_model)  # -> out, footprint, excel_objects; inputs rooms_included: list, rooms_excluded: list, ud_row_starts: list; plug-in component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
# Mech Cooling Yes | No somehow...
panel_26 = Panel(lbt_phpp.excel_objects)
branch = TreeBranch(Tree=lbt_phpp.excel_objects, Path="{14}", MaintainPaths=True)
branch_2 = TreeBranch(Tree=lbt_phpp.excel_objects, Path="{20}", MaintainPaths=True)
panel_27 = Panel(branch_2)
panel_28 = Panel(branch)
open_xl_workbook = LBT2PH_XLOpenWorkbook(
    run=Toggle(False),
    oldFilename="C:\LBT2PH_Testing\_source.xlsx",
    newDirectory="C:\LBT2PH_Testing\",
    newFilename="Output_02")  # -> excel; plug-in component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
write_xl_workbook = LBT2PH_XLWriteWorkbook(excel=open_xl_workbook, XL_Objects=lbt_phpp.excel_objects)  # -> excel, numWrites; inputs XL_Objects: tree; plug-in component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
panel_29 = Panel(write_xl_workbook.numWrites)
read_xl_workbook = LBT2PH_XLReadWorkbook()  # -> data, text, kvli; plug-in component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
