# Grasshopper definition 201127_LBT_Testing.gh (Grasshopper 1.0.7)
# plug-ins: Human

honeybee = Honeybee_Honeybee()  # -> Vviiiiiiiiiizzz; plug-in component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
new_phpp_frame = LBT2PH_CreatePHPPwindowFrame(name="gh_scene_frame")  # -> out, PHPPFrame; inputs frameWidths: list, frameUvalues: list, psiGlazings: list, psiInstalls: list; plug-in component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
ladybug = Ladybug_Ladybug()  # -> Vviiiiiiiiiizzz; plug-in component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
create_py_from_ghuser = __LBT__Util_CreatePYfromGHUSER(runIt=Toggle(False), all=False, saveDirectory=False)  # -> out, a; inputs runIt: Boolean, all: Boolean
# ---------- create_py_from_ghuser: Python ----------
"""
Will grab all the 'LBT2_' ghuser components, add them to the scene, write their code to disk, then remove them from the scene.
-
EM November 21, 2020
    Args:
        _runIt:
        all_: (bool) Default=False. If TRUE, will write ALL the BT objs. If False, will only write the ones found on the active GH Canvas.
        _ghUserDirectory: <Optional> Default = C:\Users\edpma\AppData\Roaming\Grasshopper\UserObjects\
        _saveDirectory: <Optional> Default = \\Mac\Home\Dropbox\bldgtyp-00\00_PHPP\00_IDF2PH\01_GH_Components\  (will add ..\py\.. and ..\ghuser\.. subdirs for files)
   Returns:
"""

ghenv.Component.Name = "__LBT__Util_CreatePYfromGHUSER"
ghenv.Component.NickName = "Create PY from GHUSER"
ghenv.Component.Message = 'NOV_21_2020'
ghenv.Component.IconDisplayMode = ghenv.Component.IconDisplayMode.application
ghenv.Component.Category = "PH-Tools"
ghenv.Component.SubCategory = "00 | Utils"

import os
import Grasshopper.Kernel as ghK
import shutil

def writeComponentsAsPY():
    """ Finds all compos in the scene, writes their code to a folder"""
    
    doc = ghenv.Component.OnPingDocument()
    objs = list(doc.Objects)
    
    for obj in objs:
        if obj.Category != 'PH-Tools':
            continue
        
        if 'LBT' in obj.Name[:4]:
            address = saveDir + obj.Name + '.py'
            
            if os.path.exists(address):
                os.remove(address)
            
            componentCode = obj.Code.split("\n")
            with open(address, 'wb') as f:
                for line in componentCode:
                    f.write(line.replace('\r', '\n'))

def copyGHuserFile():
    doc = ghenv.Component.OnPingDocument()
    objs = list(doc.Objects)
    
    for obj in objs:
        if obj.Category != 'PH-Tools':
            continue
        
        if 'LBT' in obj.Name[:4]:
            srcAddress = ghuserDir + obj.Name + '.ghuser'
            saveAddress = saveDir_ghUser + obj.Name + '.ghuser'
            
            if os.path.exists(srcAddress):
                shutil.copy(srcAddress, saveAddress)

def writeALLtoDisk():
    if not os.path.exists(ghuserDir):
        print('GHUser Directory not found?')
    else:
        ghuserFileNames = os.listdir(ghuserDir)
        for eachCompoName in ghuserFileNames:
            if 'LBT' in eachCompoName:
                compo = ghK.GH_UserObject(ghuserDir+eachCompoName).InstantiateObject()
                ghdoc = ghenv.Component.OnPingDocument()
                ghdoc.AddObject(compo, False)
                
                writeComponentsAsPY()
                copyGHuserFile()
                
                ghdoc.RemoveObject(compo, False)

def writeCanvasCompoToDisk():
    if not os.path.exists(ghuserDir):
        print('GHUser Directory not found?')
    else:
        writeComponentsAsPY()
        copyGHuserFile()

def copy_scripts(_source_dir, _target_dir):
    print 'copying scripts'
    print _source_dir
    print _target_dir
    
    source_files = os.listdir(_source_dir)
    for file_name in source_files:
        full_file_name = os.path.join( _source_dir, file_name )
        if os.path.isfile(full_file_name):
            shutil.copy( full_file_name, _target_dir )

ghuserDir = r"C:\Users\edpma\AppData\Roaming\Grasshopper\UserObjects"'\\'
rh_scripts_dir = r"C:\Users\edpma\AppData\Roaming\McNeel\Rhinoceros\6.0\scripts\LBT2PH"'\\'

saveDir = str(r"\\Mac\Home\Dropbox\bldgtyp-00\00_PH_Tools\LBT2PH\ghuser_py"'\\')
saveDir_ghUser = str(r"\\Mac\Home\Dropbox\bldgtyp-00\00_PH_Tools\LBT2PH\ghuser"'\\')
saveDir_rh_scripts = str(r"\\Mac\Home\Dropbox\bldgtyp-00\00_PH_Tools\LBT2PH\scripts\LBT2PH"'\\')

if _saveDirectory:
    saveDir = _saveDirectory + "\py"'\\'

if _saveDirectory:
    saveDir_ghUser = _saveDirectory + "\ghuser"'\\'

if _ghUserDirectory:
    ghuserDir = _ghUserDirectory

if not os.path.exists(saveDir):
    try:
        os.mkdir(saveDir)
    except:
        saveDir = False
        print('Please provide a valid save directory. Maybe try adding/removing the backslash to the end?')

if _runIt and saveDir and all_:
    writeALLtoDisk()

if _runIt and saveDir and not all_:
    writeCanvasCompoToDisk()

if _runIt and saveDir_rh_scripts and rh_scripts_dir:
    copy_scripts(rh_scripts_dir, saveDir_rh_scripts)
# ---------- end create_py_from_ghuser ----------
new_phpp_glazing = LBT2PH_CreatePHPPwindowGlazing(name="gh_scene_glass")  # -> out, PHPPGlazing; plug-in component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
idf2phpp = BT_CORE()  # -> out; plug-in component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
panel = Panel(new_phpp_glazing.PHPPGlazing)
geo = Geometry([<brep referenced from the Rhino model> x6])
get_surface_params = LBT2PH_GetSrfcParams(srfcs=geo, auto_orientation=Toggle(False))  # -> out, geo, name, type, bc, ep_const, rad_mod; inputs srfcs: list of Guid; plug-in component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
number_slider = Slider(12, range=0..100)
geo_2 = Geometry([<brep referenced from the Rhino model> x2])
crv = Curve(<curve referenced from the Rhino model>)
crv_duct = Curve(<curve referenced from the Rhino model>)
aperture = HBAperture(geo=geo_2)  # -> report, apertures; plug-in component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
face = HBFace(
    geo=get_surface_params.geo,
    name=get_surface_params.name,
    type=get_surface_params.type,
    bc=get_surface_params.bc,
    ep_constr=get_surface_params.ep_const)  # -> report, faces; plug-in component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
vent_duct = LBT2PH_CreateNewPHPPVentDuct(ductLength=flatten("36\""), insulThickness="36\"")  # -> out, hrvDuct; inputs ductLength: list, ductWidth: list, insulThickness: list, insulConductivity: list; plug-in component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
exhaust_vent = LBT2PH_CreateNewPHPPExhaustVentilator(name="My Test Unit", airFlowRate_On="45 CFM")  # -> out, exhaustVent; plug-in component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
ventilator = LBT2PH_CreateNewPHPPVentUnit(name="My_Example_Unit", frost_temp="28F")  # -> out, ventUnit; plug-in component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
bldgprograms = HBBuildingPrograms({"LargeOffice", "MediumOffice", "SmallOffice", "MidriseApartment", "HighriseApartment", "Retail", "StripMall", "PrimarySchool", "SecondarySchool", "SmallHotel", "LargeHotel", "Hospital", "Outpatient", "Laboratory", "Warehouse", "SuperMarket", "FullServiceRestaurant", "QuickServiceRestaurant", "Courthouse", "LargeDataCenterHighITE", "LargeDataCenterLowITE", "SmallDataCenterHighITE", "SmallDataCenterLowITE"}, selected="MidriseApartment")
phpp_aperture = LBT2PH_CreatePHPPAperture(apertures=aperture.apertures)  # -> out, apertures; inputs apertures: list, frames: list, glazings: list, psi_installs: list, installs: list; plug-in component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
searchprog = HBSearchPrograms(bldg_prog=bldgprograms)  # -> room_prog; plug-in component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
list = ItemSelector(
    searchprog,
    {"2013::MidriseApartment::Apartment", "2013::MidriseApartment::Corridor", "2013::MidriseApartment::Office"}, selected="2013::MidriseApartment::Apartment")
room = HBRoom(faces=flatten(face.faces), name="Garage", program=list, conditioned=True)  # -> report, room; plug-in component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
phpp_vent_sched = LBT2PH_CreateRoomVentSched(fanSpeed_high="1", fanSpeed_med=".5", fanSpeed_low="0.2")  # -> out, phpp_ventilation_sched; plug-in component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
panel_2 = Panel("My_Vent_System")
addsubface = HBAddSubface(hb_obj=flatten(room.room), sub_faces=flatten(phpp_aperture.apertures))  # -> hb_obj; plug-in component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
create_vent_system = LBT2PH_CreateNewPHPPVentSystem(
    vent_unit=ventilator.ventUnit,
    hrv_duct_01="15 ft",
    hrv_duct_02=vent_duct.hrvDuct,
    exhaust_vent_units=exhaust_vent.exhaustVent)  # -> out, vent_system; inputs hrv_duct_01: list, hrv_duct_02: list, exhaust_vent_units: list; plug-in component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
brep_tfa_surfaces = Brep([<brep referenced from the Rhino model> x5])  # disabled
brep = Brep(<brep referenced from the Rhino model>)  # disabled
list_2 = ValueList({"EP", "UD"}, selected="UD")
phpp_spaces = LBT2PH_CreatePHPPSpaces(
    HB_rooms=addsubface,
    set_honeybee_loads=Toggle(True),
    TFA_surfaces=flatten(brep_tfa_surfaces),
    spaces_geometry=flatten(brep),
    vent_flowrate_source=list_2,
    phpp_vent_schedule=phpp_vent_sched.phpp_ventilation_sched)  # -> out, space_breps, phpp_spaces, HB_rooms; inputs HB_rooms: list, set_honeybee_loads: Boolean, TFA_surfaces: list, spaces_geometry: list of Guid; plug-in component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
brep_2 = Brep(phpp_spaces.space_breps)
set_zone_vent = LBT2PH_SetZoneVentSystem(vent_system=create_vent_system.vent_system, HB_rooms=flatten(phpp_spaces.HB_rooms))  # -> out, HB_rooms; inputs HB_rooms: list; plug-in component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
airtightness = LBT2PH_Airtightness(HB_rooms=flatten(set_zone_vent.HB_rooms), n50="1.15", blower_pressure="50")  # -> out, HB_rooms; inputs HB_rooms: list; plug-in component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
# Double check the Reveal dims.. divid by 2?
create_window_reveals = LBT2PH_CreateWindowReveals(HB_rooms=flatten(airtightness.HB_rooms))  # -> out, HB_rooms, window_surrounds, envelope_surfaces, port, window_names, window_surfaces, envelope_surfaces_punched; inputs HB_rooms: list; plug-in component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
shading_factors_simple = LBT2PH_CalcWindowShadingFactors_Simple(
    runIt=Toggle(True),
    latitude="40",
    HB_rooms=create_window_reveals.HB_rooms,
    window_surrounds=simplify(create_window_reveals.window_surrounds),
    envelope_surfaces=simplify(flatten(create_window_reveals.envelope_surfaces)))  # -> out, HB_rooms, checklines; inputs HB_rooms: list, window_surrounds: tree, envelope_surfaces: list, shading_surfaces: list; plug-in component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
panel_3 = Panel("""0.67
0.54""")
panel_4 = Panel("""0.3
0.4""")
line = Line(shading_factors_simple.checklines)
apply_win_shading_factors = LBT2PH_ApplyWindowShadingFactors(
    HB_rooms=shading_factors_simple.HB_rooms,
    window_names=create_window_reveals.window_names,
    winter_shading_factors=panel_3,
    summer_shading_factors=panel_4)  # -> out, HB_rooms; inputs HB_rooms: list, window_names: list, winter_shading_factors: list, summer_shading_factors: list; plug-in component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
crv_2 = Curve(<curve referenced from the Rhino model>)
srf = Surface(<surface referenced from the Rhino model>)
# - Figure out if its adding the banks together right
# - Add support for exterior piping
geo_3 = Geometry([<curve referenced from the Rhino model> x3])
panel_5 = Panel("""19
4'""")
panel_6 = Panel("4 IP")
panel_7 = Panel("45")
panel_8 = Panel("12 GA")
panel_9 = Panel("2")
panel_10 = Panel("4\"")
panel_11 = Panel("""12
18 in""")
crv_3 = Curve([<curve referenced from the Rhino model> x3])
panel_12 = Panel("3")
panel_13 = Panel("45 F")
list_3 = ValueList({"1", "2"}, selected="1")
panel_15 = Panel("6\"")
panel_16 = Panel("4 R/IN")
list_4 = ValueList({"1", "2", "3", "4"}, selected="1")
srf_2 = Surface(<surface referenced from the Rhino model>)
piping_recirc = LBT2PH_DHW_Piping_Recirc(pipe_geom=panel_5)  # -> out, circulation_piping; inputs pipe_geom: list, pipe_diam: list, insulThickness: list, insulConductivity: list, insulReflective: list of Boolean; plug-in component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
dhw_usage = LBT2PH_DHW_Usage(useType=list_3)  # -> out, usage; plug-in component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
dhw_tank = LBT2PH_DHW_Tank(tank_solar=Toggle(False))  # -> out, storage_tank; inputs tank_solar: Boolean; plug-in component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
piping_branches = LBT2PH_DHW_Piping_Banches(pipe_geom=crv_3)  # -> out, branch_piping; inputs pipe_geom: list; plug-in component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
create_floor_element = LBT2PH_GroundContactElement(HB_rooms=apply_win_shading_factors.HB_rooms, type=list_4)  # -> out, ground_elements, HB_rooms; inputs HB_rooms: list, floor_surfaces: list, exposedPerimCrvs: list; plug-in component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
panel_17 = Panel(create_floor_element.ground_elements)
dhw = LBT2PH_DHW_System(
    HB_rooms=create_floor_element.HB_rooms,
    usage=dhw_usage.usage,
    circulation_piping=piping_recirc.circulation_piping,
    branch_piping=piping_branches.branch_piping,
    tank1=dhw_tank.storage_tank,
    tank2=dhw_tank.storage_tank)  # -> out, HB_rooms; inputs HB_rooms: list, circulation_piping: list, branch_piping: list; plug-in component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
panel_18 = Panel(dhw.HB_rooms)
range = Range(Domain=Domain(0, 1), Steps="14")
panel_19 = Panel("""-15.0	38.6	4.90	2.11
-5.0	44.0	5.34	2.41
0.0	54.3	5.42	2.54
-4.9	19.6	5.49	2.78
-1.3	22.3	6.26	2.96
-15.0	35.7	2.45	1.71
-5.0	40.9	2.67	1.88
0.0	51.1	2.71	1.70
0.0	16.3	2.75	4.49
4.4	18.6	3.13	5.10""")
panel_20 = Panel(range)
list_5 = ValueList({"1-Outdoor air", "2-Ground water", "3-Ground probes", "4-Horizontal ground collector"}, selected="2-Ground water")
list_6 = ValueList({"1-Underfloor heating", "2-Radiators", "3-Supply air heating"}, selected="2-Radiators")
panel_21 = Panel("350 IP")
panel_22 = Panel("5 F")
pnll_resi_loads_schedules = LBT2PH_PNLL_Resi_Loads(HB_rooms=dhw.HB_rooms)  # -> out, HB_rooms, port, PNNL_ElecEquip_Load, PNNL_Lighting_Load, PNNL_Occup_Load, port_2, PNNL_SF_Occup_Sched, PNNL_SF_Lighting_Sched, PNNL_ElecEquip_Sched; inputs HB_rooms: list; plug-in component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
cooling_recirc = LBT2PH_CreateCooling_Recirc(on_off_mode=Toggle(True), max_cooling_cap="3 ton", vol_flow_at_nom_power="400 IP", SEER="4 BTU/W")  # -> out, recirc_air_cooling; inputs on_off_mode: Boolean, variable_vol: Boolean; plug-in component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
cooling_dehumid = LBT2PH_CreateCooling_Dehumidification(waste_heat_to_room=Toggle(True), SEER="45 IP")  # -> out, dehumid_cooling; inputs waste_heat_to_room: Boolean; plug-in component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
heating_hp_options = LBT2PH_Heating_ASHP_Options(design_forward_water_temp="140 F", hp_distribution=list_6)  # -> out, hp_options; plug-in component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
cooling_sup_air = LBT2PH_CreateCooling_SupplyAir(on_off_mode=Toggle(True), max_cooling_cap="3 ton", SEER="12 IP")  # -> out, supply_air_cooling; inputs on_off_mode: Boolean; plug-in component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
heating_hp = LBT2PH_Heating_ASHP(source=list_5)  # -> out, heat_pump; inputs fromPHPP: list, temps_source: list, temps_sink: list, heating_capacities: list, COPs: list; plug-in component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
cooling_panel = LBT2PH_CreateCooling_Panel(SEER="45 IP")  # -> out, panel_cooling; plug-in component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
panel_23 = Panel("12")
list_7 = ValueList({"1", "2", "3", "4", "5", "6"}, selected="5")
summervent = LBT2PH_SummerVentilation(HB_rooms=pnll_resi_loads_schedules.HB_rooms, use_default=Toggle(True))  # -> out, HB_rooms; inputs HB_rooms: list, use_default: Boolean; plug-in component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
list_8 = ValueList({"1", "2", "3", "4", "5", "6"}, selected="2")
heating_cooling_systems = LBT2PH_SetSystems(
    HB_rooms=summervent.HB_rooms,
    primary_heat_generation=list_7,
    secondary_heat_generation=list_8,
    mech_cooling=Toggle(True),
    hp_heating=heating_hp.heat_pump,
    hp_options=heating_hp_options.hp_options,
    recirc_air_cooling=cooling_recirc.recirc_air_cooling)  # -> out, HB_rooms; inputs HB_rooms: list, mech_cooling: Boolean; plug-in component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

# ----
# Download EPW File
panel_24 = Panel("https://www.energyplus.net/weather-download/north_and_central_america_wmo_region_4/USA/MA/USA_MA_Boston-Logan.Intl.AP.725090_TMY3/all")
downloadepw = LBDownloadWeather(weather_URL=panel_24)  # -> epw_file, stat_file, ddy_file; plug-in component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

model = HBModel(rooms=flatten(heating_cooling_systems.HB_rooms), name="Test Model")  # -> report, model; plug-in component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
vizbytype = HBVisualizeByType(rooms=model.model)  # -> walls, interior_walls, roofs, ceilings, exterior_floors, interior_floors, air_walls, apertures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; plug-in component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
panel_25 = Panel("""12
14
25""")
crv_4 = Curve([<curve referenced from the Rhino model> x2])
python = GhPythonScript(x=create_floor_element.HB_rooms)  # -> out, a
# ---------- python: Python ----------
import json
#for space in x.user_data['phpp']['spaces'].values():
    #print space['vent_sched']

print json.dumps(x.user_data['phpp']['ground'], indent=2)
# ---------- end python ----------
panel_26 = Panel(python.out)
thermal_bridges = LBT2PH_SetTB(model=model.model, estimated_tb="12", linear_tb_lengths=crv_4, point_tb_ChiValues=panel_25)  # -> out, HB_model; inputs linear_tb_lengths: list, linear_tb_psi_values: list, linear_tb_fRsi_values: list, point_tb_Names: list, point_tb_ChiValues: list, point_tb_fRsi_values: list; plug-in component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
panel_28 = Panel("20")
list_9 = ValueList({"1", "2", "3", "4"}, selected="1")
phpp_occupancy = LBT2PH_SetPHPPOccupancy(HB_model=thermal_bridges.HB_model, set_honeybee_loads=Toggle(True), buildingType=list_9)  # -> out, occupancy_sch, ppl_per_area, HB_model; inputs set_honeybee_loads: Boolean; plug-in component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
panel_29 = Panel("""A Tst, 56
Another, 455""")
phpp_res_appliances = LBT2PH_SetResAppliances(HB_model=phpp_occupancy.HB_model, use_resi_defaults=Toggle(True), set_honeybee_loads=Toggle(True), other=panel_29)  # -> out, HB_model; inputs use_resi_defaults: Boolean, set_honeybee_loads: Boolean, other: list; plug-in component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
phpp_setup = LBT2PH_SetPHPPSetup(HB_model=phpp_res_appliances.HB_model)  # -> out, HB_model; plug-in component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
lbt_phpp = LBT2PH_ConvertLBT2PHPPObjs(epw_file=downloadepw.epw_file, model=phpp_setup.HB_model)  # -> out, footprint, excel_objects; inputs rooms_included: list, rooms_excluded: list, ud_row_starts: list; plug-in component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
panel_30 = Panel(lbt_phpp.excel_objects)
branch = TreeBranch(Tree=lbt_phpp.excel_objects, Path="{16}", MaintainPaths=True)
branch_2 = TreeBranch(Tree=lbt_phpp.excel_objects, Path="{20}", MaintainPaths=True)
panel_31 = Panel(branch_2)
panel_32 = Panel(branch)
open_xl_workbook = LBT2PH_XLOpenWorkbook(
    run=Toggle(False),
    oldFilename="C:\LBT2PH_Testing\_source.xlsx",
    newDirectory="C:\LBT2PH_Testing\",
    newFilename="Output_04")  # -> excel; plug-in component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
write_xl_workbook = LBT2PH_XLWriteWorkbook(excel=open_xl_workbook, XL_Objects=lbt_phpp.excel_objects)  # -> excel, numWrites; inputs XL_Objects: tree; plug-in component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
panel_33 = Panel(write_xl_workbook.numWrites)
read_xl_workbook = LBT2PH_XLReadWorkbook()  # -> data, text, kvli; plug-in component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
