# Grasshopper definition 201105_LBT_Testing.gh (Grasshopper 1.0.7)

honeybee = Honeybee_Honeybee()  # -> Vviiiiiiiiiizzz; plug-in component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
ladybug = Ladybug_Ladybug()  # -> Vviiiiiiiiiizzz; plug-in component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
idf2phpp = BT_CORE()  # -> out; plug-in component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
new_phpp_frame = LBT2PH_CreatePHPPwindowFrame(name="gh_scene_frame")  # -> out, PHPPFrame; inputs frameWidths: list, frameUvalues: list, psiGlazings: list, psiInstalls: list; plug-in component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
new_phpp_glazing = LBT2PH_CreatePHPPwindowGlazing(name="gh_scene_glass")  # -> out, PHPPGlazing; plug-in component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
panel = Panel(new_phpp_glazing.PHPPGlazing)
panel_2 = Panel(new_phpp_frame.PHPPFrame)
geo = Geometry([<brep referenced from the Rhino model> x6])
get_surface_params = LBT2PH_GetSrfcParams(srfcs=geo, auto_orientation=Toggle(False))  # -> out, geo, name, type, bc, ep_const, rad_mod; inputs srfcs: list of Guid; plug-in component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
geo_2 = Geometry([<brep referenced from the Rhino model> x2])
aperture = HBAperture(geo=geo_2)  # -> report, apertures; plug-in component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

# ---- group: Dynamically Chage Glazing Ratio
number_slider = Slider(0.4, range=-0.1..0.9)  # disabled

# ----
# Create Honeybee Model
panel_3 = Panel("outdoors")  # disabled
panel_4 = Panel("adiabatic")  # disabled
geo_3 = Geometry([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])  # disabled
geo_4 = Geometry(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)  # disabled
face = HBFace(geo=geo_3, bc=panel_3)  # -> report, faces; disabled; plug-in component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
face_2 = HBFace(geo=geo_4, bc=panel_4)  # -> report, faces; disabled; plug-in component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
panel_5 = Panel("2013::LargeOffice::OpenOffice")  # disabled
panel_6 = Panel("2013::ClimateZone5::SteelFramed")  # disabled
aperturesbyratio = HBAperturesByRatio(hb_objs=flatten(face.faces), ratio=number_slider)  # -> report, hb_objs; disabled; plug-in component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
all_air = HBAllAirHVACTemplates({"VAV chiller with gas boiler reheat", "VAV chiller with central air source heat pump reheat", "VAV chiller with district hot water reheat", "VAV chiller with PFP boxes", "VAV chiller with gas coil reheat", "VAV air-cooled chiller with gas boiler reheat", "VAV air-cooled chiller with central air source heat pump reheat", "VAV air-cooled chiller with district hot water reheat", "VAV air-cooled chiller with PFP boxes", "VAV air-cooled chiller with gas coil reheat"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}, selected="VAV chiller with gas boiler reheat")  # disabled
panel_7 = Panel("Office Shoe Box")  # disabled
panel_8 = Panel("ShoeBox")  # disabled
room = HBRoom(
    faces=flatten([face_2.faces, aperturesbyratio.hb_objs]),
    name=panel_7,
    constr_set=panel_6,
    program=panel_5,
    conditioned=True)  # -> report, room; disabled; plug-in component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
panel_9 = Panel("DifferentialDryBulb")  # disabled
concat = Concatenate(FragmentA=panel_8, FragmentB=number_slider)  # disabled
panel_10 = Panel("VAV System")  # disabled
allairhvac = HBAllAirHVAC(rooms=flatten(room.room), system_type=all_air, name=panel_10)  # -> report, rooms; disabled; plug-in component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
model = HBModel(rooms=flatten(allairhvac.rooms), name=concat)  # -> report, model; disabled; plug-in component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

face_3 = HBFace(
    geo=get_surface_params.geo,
    name=get_surface_params.name,
    type=get_surface_params.type,
    bc=get_surface_params.bc,
    ep_constr=get_surface_params.ep_const)  # -> report, faces; plug-in component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
python = GhPythonScript()  # -> out, a
# ---------- python: Python ----------
from random import randint

class Cheese(object):
    def __init__(self, num_holes=0):
        "defaults to a solid cheese"
        self.number_of_holes = num_holes

    @classmethod
    def random(cls):
        return cls(randint(0, 100))

    @classmethod
    def slightly_holey(cls):
        return cls(randint(0, 33))

    @classmethod
    def very_holey(cls):
        return cls(randint(66, 100))


x = Cheese()
y = Cheese.random()

print y.number_of_holes
# ---------- end python ----------
phpp_aperture = LBT2PH_CreatePHPPAperture(apertures=aperture.apertures)  # -> out, apertures; inputs apertures: list, frames: list, glazings: list, psi_installs: list, installs: list; plug-in component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
room_2 = HBRoom(faces=flatten(face_3.faces), name="Garage", conditioned=True)  # -> report, room; plug-in component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
addsubface = HBAddSubface(hb_obj=flatten(room_2.room), sub_faces=flatten(phpp_aperture.apertures))  # -> hb_obj; plug-in component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
brep_tfa_surfaces = Brep([<brep referenced from the Rhino model> x5])
python_2 = GhPythonScript()  # -> out, a
# ---------- python_2: Python ----------
x = set([1,2,33,4])
y = set([1,33,66464,66])

print list( x & y )
# ---------- end python_2 ----------

# ----
# Request Outputs
toggle = BooleanToggle(True)  # disabled
simoutput = HBSimulationOutput(zone_energy_use=toggle, hvac_energy_use=toggle)  # -> report, sim_output; disabled; plug-in component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
simpar = HBSimulationParameter(output=simoutput.sim_output, timestep=6)  # -> sim_par; disabled; plug-in component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

phpp_rooms_from_rhino = BT_PHPProomsFromRH()  # -> out, roomBreps, rooms, HBZones; inputs roomTFASurfaces: list of Guid, roomGeometry: list of Guid, HBZones: list; plug-in component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
phpp_rooms_from_rhino_2 = BT_PHPProomsFromRH(TFA_surfaces=flatten(brep_tfa_surfaces), HB_rooms=addsubface)  # -> out, room_breps, phpp_rooms, HB_rooms; inputs TFA_surfaces: list of Guid, spaces_geometry: list of Guid, HB_rooms: list
#   port TFA_surfaces: (List) An input for the user-determined room floor area(s) to use. Supply inputs as surfaces. Use the Rhino tools to apply TFA information (TFA Factor, Roomname, etc..) in the Rhino scene before passing in here. Will bundle together rooms with the same number+name and will try and join together tfa surfaces that touch (if they have the same number+name).
# ---------- phpp_rooms_from_rhino_2: Python ----------
import rhinoscriptsyntax as rs
import Rhino

import LBT2PH
import LBT2PH.helpers
import LBT2PH.spaces
from ladybug_geometry.geometry3d import Point3D

reload(LBT2PH)
reload(LBT2PH.helpers)
reload(LBT2PH.spaces)

#
# Make it so you can pass in either Rhino geom (Guid) or GH generated Geometry
#

HB_rooms_ = []
#    For each 'Room', build a default 'Space'
#       - inset the floor surface based on wall thicknesses (maybe?)
#       - Create a new TFA floor object for the 'Space'
#       - Calc Vent flow rates automatically

# ------------------------------------------------------------------------------
# Get the UD Space Geometry
with LBT2PH.helpers.context_rh_doc(ghdoc):
    room_geom_breps = [rs.coercebrep(guid) for guid in _spaces_geometry]
    rhino_tfa_objects = [LBT2PH.spaces.get_tfa_surface_data_from_Rhino(guid) for guid in _TFA_surfaces]


if _HB_rooms:
    
    tfa_objs = {}
    for tfa_srfc_geom, tfa_srfc_name, tfa_srfc_params in rhino_tfa_objects:
        # ----------------------------------------------------------------------
        # Find the TFA's host Room/Zone
        srfc_centroid = Rhino.Geometry.AreaMassProperties.Compute(tfa_srfc_geom).Centroid
        srfc_centroid = Point3D(srfc_centroid.X, srfc_centroid.Y, srfc_centroid.Z)
        host_room = None
        for room in _HB_rooms:
            if room.geometry.is_point_inside( srfc_centroid ):
                host_room = room.display_name
                break
        
        tfa_obj = LBT2PH.spaces.TFA_Surface(tfa_srfc_geom, host_room, tfa_srfc_params)
        
        # ----------------------------------------------------------------------
        # Add the new TFA Object to the master dict
        tfa_dict_key = tfa_obj.get_dict_key()
        
        d = { tfa_obj.id : tfa_obj }
        if tfa_dict_key in tfa_objs:
            tfa_objs[tfa_dict_key].update(d)
        else:
            tfa_objs[tfa_dict_key] = d


# ------------------------------------------------------------------------------
# Find all the 'touching' TFA surfaces
for tfa_obj_list in tfa_objs.values():
    LBT2PH.spaces.find_neighbors( tfa_obj_list )


srfcSets = {}
for room_name, room in tfa_objs.items():
    print room_name
    for k2, v2 in room.items():
        print '----', k2
        print '    >', v2, v2.neighbors
        print len(v2.neighbors)
        
        
        
        
        if len(v2.neighbors) == 1:
            srfcSets[v2.id] = [v2]
        """
        else:
            if v2.neighbors not in srfcSets.keys():
                srfcSets[v2.neighbors] = [v2]
            else:
                srfcSets[v2.neighbors].append(v2)
        """
        


for k, v in srfcSets.items():
    print k, v





"""
    for hb_room in _HB_rooms:
        floor_surfaces = LBT2PH.spaces.get_hb_room_floor_surfaces(hb_room)
        
        # ----------------------------------------------------------------------
        # Build the TFA Surfaces
        tfa_surfaces = []
        for floor_surface in floor_surfaces:
            new_TFA_srfc = LBT2PH.spaces.TFA_Surface(floor_surface, hb_room)
            tfa_surfaces.append(new_TFA_srfc)
        
        
        
        
        tfa_surfaces = LBT2PH.spaces.join_touching_tfa_surfaces( tfa_surfaces )
        
        # ----------------------------------------------------------------------
        # Build the volumes from the TFA spaces
        volumes = []
        for tfa_surface in tfa_surfaces:
            new_volume = LBT2PH.spaces.Volume(tfa_surface)
            volumes.append(new_volume)
        
        # How to combine volumes together if they are part of same room?
        
        # ----------------------------------------------------------------------
        # Build the spaces from the volumes
        spaces = []
        for volume in volumes:
            new_space = LBT2PH.spaces.Space(volume)
            spaces.append(new_space)
        
        # ----------------------------------------------------------------------
        # Pack all the spaces onto the Room's user_data attribute
        room = hb_room.duplicate()
        for space in spaces:
            LBT2PH.helpers.add_to_hb_obj_user_data(room, 'rooms', space.to_dict())
        
        HB_rooms_.append(room)
        """
        
        
        
        
        
        
    # If TFA Surfaces are passed in:
        # Create TFA surface for each
        # Join together touching TFA srfcs, create a new 'floor' geom for volume tests
        # Create Space volume based on Room/Zone
        # Get fresh air flow rate info from Rhino model



# If TFA Srfcs and Room Geom passed in:
# ---------- end phpp_rooms_from_rhino_2 ----------
panel_11 = Panel(phpp_rooms_from_rhino_2.HB_rooms)

# ----
# Download EPW File
panel_12 = Panel("https://www.energyplus.net/weather-download/north_and_central_america_wmo_region_4/USA/MA/USA_MA_Boston-Logan.Intl.AP.725090_TMY3/all")  # disabled
downloadepw = LBDownloadWeather(weather_URL=panel_12)  # -> epw_file, stat_file, ddy_file; disabled; plug-in component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

python_3 = GhPythonScript()  # -> out, a
# ---------- python_3: Python ----------
x = set([1,2,3,4,])

print 1 in x

print 1 in list(x)
# ---------- end python_3 ----------
model_2 = HBModel(rooms=flatten(phpp_rooms_from_rhino_2.HB_rooms), name="Test Model")  # -> report, model; plug-in component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
python_4 = GhPythonScript(x=phpp_rooms_from_rhino_2.HB_rooms)  # -> out, a
# ---------- python_4: Python ----------
import json
print json.dumps(x.user_data, indent=4)
# ---------- end python_4 ----------

# ----
# Download EPW File
panel_13 = Panel("https://www.energyplus.net/weather-download/north_and_central_america_wmo_region_4/USA/MA/USA_MA_Boston-Logan.Intl.AP.725090_TMY3/all")
downloadepw_2 = LBDownloadWeather(weather_URL=panel_13)  # -> epw_file, stat_file, ddy_file; plug-in component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

panel_14 = Panel(python_4.out)
vizbytype = HBVisualizeByType(rooms=model_2.model)  # -> walls, interior_walls, roofs, ceilings, exterior_floors, interior_floors, air_walls, apertures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; plug-in component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
panel_15 = Panel(simpar)  # disabled
python_5 = GhPythonScript(model=model_2.model)  # -> out, a; inputs model: list; disabled
# ---------- python_5: Python ----------
import json

for m in model:
    for a in m.apertures:
        print '- '*50
        print a.user_data
        print a.user_data['phpp']['aperture_params']
        print '- '*25
        print(a.user_data['phpp']['aperture_params']['GlazingType'])
        j = json.loads(a.user_data['phpp']['aperture_params']['GlazingType'])
        print j['_nm']
        print
        j = json.loads(a.user_data['phpp']['aperture_params']['FrameType'])
        print j['_nm']
        
        #print a.properties.energy.construction
# ---------- end python_5 ----------
connect_to_run__to_only_write_idf = Panel("2")  # disabled
toggle_2 = BooleanToggle(False)  # disabled
panel_16 = Panel(python_5.out)  # disabled
vizbytype_2 = HBVisualizeByType(rooms=model.model)  # -> walls, interior_walls, roofs, ceilings, exterior_floors, interior_floors, air_walls, apertures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; disabled; plug-in component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
modeltoosm = HBModelToOSM(model=model.model, epw_file=downloadepw.epw_file, sim_par=simpar, write=toggle_2, run=toggle_2)  # -> report, jsons, osw, osm, idf, sql, zsz, rdd, html; disabled; plug-in component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
idf_phpp_objs = BT_IDF2PHPPObjs()  # -> out, opaqueSurfaces, windowObjects, zoneNames, PHPPObjs; inputs HBZones: list, IDF_Objs_List: list; plug-in component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
lbt_phpp_objs = LBT2PH_ConvertLBT2PHPPObjs(epw_file=downloadepw_2.epw_file, model=model_2.model)  # -> out, PHPP_Objs; plug-in component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
panel_17 = Panel(lbt_phpp_objs.PHPP_Objs)

# ----
# Visualize Results
roomenergyresult = HBReadRoomEnergyResult(sql=modeltoosm.sql)  # -> cooling, heating, lighting, electric_equip, gas_equip, fan_electric, pump_electric, people_gain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; disabled; plug-in component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
hourlyplot = LBHourlyPlot(data=[roomenergyresult.cooling, roomenergyresult.heating, roomenergyresult.fan_electric, roomenergyresult.pump_electric])  # -> report, mesh, legend, borders, labels, title; disabled; plug-in component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

# ----
# Optionally Execute Simulations in Parallel
data = Data(modeltoosm.osw)  # disabled
data_2 = Data(modeltoosm.idf)  # disabled
data_3 = Data(downloadepw.epw_file)  # disabled
rec = DataRecorder(data, DataLimit=-10, RecordData=True)  # disabled
rec_2 = DataRecorder(data_2, DataLimit=-10, RecordData=True)  # disabled
toggle_3 = BooleanToggle(False)  # disabled
toggle_4 = BooleanToggle(False)  # disabled
toggle_5 = BooleanToggle(True)  # disabled
toggle_6 = BooleanToggle(True)  # disabled
runidf = HBRunIDF(idf=rec_2, epw_file=data_3, parallel=toggle_5, run=toggle_4)  # -> report, sql, zsz, rdd, html; disabled; plug-in component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
runosw = HBRunOSW(osw=rec, epw_file=data_3, parallel=toggle_6, translate=toggle_3, run=toggle_3)  # -> report, osm, idf, sql, zsz, rdd, html; disabled; plug-in component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

create_excel_obj_geom = LBT2PH_CreateXLObj_Geom(PHPPObjs=lbt_phpp_objs.PHPP_Objs)  # -> out, toPHPP_Geom; inputs PHPPObjs: tree, zonesInclude: list, zoneExclude: list, tfa: list, thermalBridges: list, grndFloorElements: list, udRowStarts: list; plug-in component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
open_xl_workbook = BT_XLOpenWorkbook(
    run=Toggle(False),
    oldFilename="C:\LBT2PH_Testing\_source.xlsx",
    newDirectory="C:\LBT2PH_Testing\",
    newFilename="output3")  # -> excel; plug-in component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
write_xl_workbook = BT_XLWriteWorkbook(excel=open_xl_workbook, XL_Objects=create_excel_obj_geom.toPHPP_Geom)  # -> excel, numWrites; inputs XL_Objects: tree; plug-in component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
