# Grasshopper definition 201108_LBT_Testing.gh (Grasshopper 1.0.7)

honeybee = Honeybee_Honeybee()  # -> Vviiiiiiiiiizzz; plug-in component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
ladybug = Ladybug_Ladybug()  # -> Vviiiiiiiiiizzz; plug-in component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
idf2phpp = BT_CORE()  # -> out; plug-in component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
new_phpp_frame = LBT2PH_CreatePHPPwindowFrame(name="gh_scene_frame")  # -> out, PHPPFrame; inputs frameWidths: list, frameUvalues: list, psiGlazings: list, psiInstalls: list; plug-in component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
new_phpp_glazing = LBT2PH_CreatePHPPwindowGlazing(name="gh_scene_glass")  # -> out, PHPPGlazing; plug-in component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
panel = Panel(new_phpp_glazing.PHPPGlazing)
panel_2 = Panel(new_phpp_frame.PHPPFrame)
geo = Geometry([<brep referenced from the Rhino model> x6])
get_surface_params = LBT2PH_GetSrfcParams(srfcs=geo, auto_orientation=Toggle(False))  # -> out, geo, name, type, bc, ep_const, rad_mod; inputs srfcs: list of Guid; plug-in component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
geo_2 = Geometry([<brep referenced from the Rhino model> x2])
panel_3 = Panel("12")
aperture = HBAperture(geo=geo_2)  # -> report, apertures; plug-in component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

# ---- group: Dynamically Chage Glazing Ratio
number_slider = Slider(0.4, range=-0.1..0.9)  # disabled

# ----
# Create Honeybee Model
panel_4 = Panel("outdoors")  # disabled
panel_5 = Panel("adiabatic")  # disabled
geo_3 = Geometry([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])  # disabled
geo_4 = Geometry(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)  # disabled
face = HBFace(geo=geo_3, bc=panel_4)  # -> report, faces; disabled; plug-in component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
face_2 = HBFace(geo=geo_4, bc=panel_5)  # -> report, faces; disabled; plug-in component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
panel_6 = Panel("2013::LargeOffice::OpenOffice")  # disabled
panel_7 = Panel("2013::ClimateZone5::SteelFramed")  # disabled
aperturesbyratio = HBAperturesByRatio(hb_objs=flatten(face.faces), ratio=number_slider)  # -> report, hb_objs; disabled; plug-in component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
all_air = HBAllAirHVACTemplates({"VAV chiller with gas boiler reheat", "VAV chiller with central air source heat pump reheat", "VAV chiller with district hot water reheat", "VAV chiller with PFP boxes", "VAV chiller with gas coil reheat", "VAV air-cooled chiller with gas boiler reheat", "VAV air-cooled chiller with central air source heat pump reheat", "VAV air-cooled chiller with district hot water reheat", "VAV air-cooled chiller with PFP boxes", "VAV air-cooled chiller with gas coil reheat"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}, selected="VAV chiller with gas boiler reheat")  # disabled
panel_8 = Panel("Office Shoe Box")  # disabled
panel_9 = Panel("ShoeBox")  # disabled
room = HBRoom(
    faces=flatten([face_2.faces, aperturesbyratio.hb_objs]),
    name=panel_8,
    constr_set=panel_7,
    program=panel_6,
    conditioned=True)  # -> report, room; disabled; plug-in component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
panel_10 = Panel("DifferentialDryBulb")  # disabled
concat = Concatenate(FragmentA=panel_9, FragmentB=number_slider)  # disabled
panel_11 = Panel("VAV System")  # disabled
allairhvac = HBAllAirHVAC(rooms=flatten(room.room), system_type=all_air, name=panel_11)  # -> report, rooms; disabled; plug-in component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
model = HBModel(rooms=flatten(allairhvac.rooms), name=concat)  # -> report, model; disabled; plug-in component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

face_3 = HBFace(
    geo=get_surface_params.geo,
    name=get_surface_params.name,
    type=get_surface_params.type,
    bc=get_surface_params.bc,
    ep_constr=get_surface_params.ep_const)  # -> report, faces; plug-in component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
crv_duct = Curve(<curve referenced from the Rhino model>)
vent_duct = BT_CreateNewPHPPVentDuct(ductLength=flatten(crv_duct))  # -> out, hrvDuct; inputs ductLength: list, ductWidth: list, insulThickness: list, insulConductivity: list; plug-in component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
exhaust_vent = BT_CreateNewPHPPExhaustVentilator(name="Another One")  # -> out, exhaustVent; plug-in component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
exhaust_vent_2 = BT_CreateNewPHPPExhaustVentilator(name="My Test Unit")  # -> out, exhaustVent; plug-in component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
phpp_aperture = LBT2PH_CreatePHPPAperture(apertures=aperture.apertures)  # -> out, apertures; inputs apertures: list, frames: list, glazings: list, psi_installs: list, installs: list; plug-in component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
room_2 = HBRoom(faces=flatten(face_3.faces), name="Garage", conditioned=True)  # -> report, room; plug-in component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
ventilator = BT_CreateNewPHPPVentUnit(name="My_Example_Unit")  # -> out, ventUnit; plug-in component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
addsubface = HBAddSubface(hb_obj=flatten(room_2.room), sub_faces=flatten(phpp_aperture.apertures))  # -> hb_obj; plug-in component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
brep_tfa_surfaces = Brep([<brep referenced from the Rhino model> x5])
brep = Brep(<brep referenced from the Rhino model>)

# ----
# Request Outputs
toggle = BooleanToggle(True)  # disabled
simoutput = HBSimulationOutput(zone_energy_use=toggle, hvac_energy_use=toggle)  # -> report, sim_output; disabled; plug-in component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
simpar = HBSimulationParameter(output=simoutput.sim_output, timestep=6)  # -> sim_par; disabled; plug-in component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

phpp_rooms_from_rhino = BT_PHPProomsFromRH(TFA_surfaces=flatten(brep_tfa_surfaces), spaces_geometry=flatten(brep), HB_rooms=addsubface)  # -> out, space_breps, phpp_spaces, HB_rooms; inputs TFA_surfaces: list of Guid, spaces_geometry: list of Guid, HB_rooms: list
#   port TFA_surfaces: (List) An input for the user-determined room floor area(s) to use. Supply inputs as surfaces. Use the Rhino tools to apply TFA information (TFA Factor, Roomname, etc..) in the Rhino scene before passing in here. Will bundle together rooms with the same number+name and will try and join together tfa surfaces that touch (if they have the same number+name).
# ---------- phpp_rooms_from_rhino: Python ----------
import rhinoscriptsyntax as rs
import Rhino
import ghpythonlib.components as ghc
import Grasshopper.Kernel as ghK
from copy import deepcopy

import LBT2PH
import LBT2PH.helpers
import LBT2PH.spaces
import LBT2PH.ventilation

reload(LBT2PH)
reload(LBT2PH.helpers)
reload(LBT2PH.spaces)
reload(LBT2PH.ventilation)

#
# Make it so you can pass in either Rhino geom (Guid) or GH generated Geometry
#
# ------------------------------------------------------------------------------
# Get the UD Space Geometry
with LBT2PH.helpers.context_rh_doc(ghdoc):
    space_geom = [rs.coercebrep(guid) for guid in _spaces_geometry]
    rhino_tfa_objects = [LBT2PH.spaces.get_tfa_surface_data_from_Rhino(guid) for guid in _TFA_surfaces]

HB_rooms_ = []
if _HB_rooms:
    tfa_objs = {}
    for tfa_srfc_geom, tfa_srfc_name, tfa_srfc_params in rhino_tfa_objects:
        # ----------------------------------------------------------------------
        # Find the TFA's host Room/Zone
        host_room = LBT2PH.spaces.find_tfa_host_room(tfa_srfc_geom, _HB_rooms)
        tfa_obj = LBT2PH.spaces.TFA_Surface(tfa_srfc_geom, host_room, tfa_srfc_params)
        if host_room is None: LBT2PH.spaces.display_host_error(tfa_obj, ghenv)
        
        # ----------------------------------------------------------------------
        # Add the new TFA Object to the master dict
        tfa_dict_key = tfa_obj.dict_key
        
        d = { tfa_obj.id : tfa_obj }
        if tfa_dict_key in tfa_objs: tfa_objs[tfa_dict_key].update(d)
        else: tfa_objs[tfa_dict_key] = d


# ------------------------------------------------------------------------------
# Find all the 'touching' TFA surfaces, organize by 'neighbor' into groups
for tfa_obj_list in tfa_objs.values():
    LBT2PH.spaces.find_neighbors( tfa_obj_list )

tfa_srfcs_grouped_by_neighbor = LBT2PH.spaces.bin_tfa_srfcs_by_neighbor(tfa_objs)
tfa_srfcs_cleaned = LBT2PH.spaces.join_touching_tfa_groups(tfa_srfcs_grouped_by_neighbor)

# ------------------------------------------------------------------------------
# Build the rooms for each tfa surface
phpp_rooms_dict = {}
for tfa_srfc in tfa_srfcs_cleaned:
    # See if you can make a closed room Brep
    # If you can, create a new Room Volume from the closed Brep set
    # Then remove that Room's Geom from the set to test (to speed future search?)
    # If no closables match found, create a default room volume
    # If no room geom input, just build a default size room for each
    
    # --------------------------------------------------------------------------
    if _spaces_geometry:
        for i, space_geometry in enumerate(space_geom):
            joined_vol = ghc.BrepJoin([space_geometry, tfa_srfc.surface])
            if joined_vol.closed is True:
                new_room_vol = LBT2PH.spaces.Volume( tfa_srfc, joined_vol )
                _spaces_geometry.pop(i)
                break
        else:
            msg = 'Could not join {} with any space geometry.'.format(tfa_srfc.dict_key)
            ghenv.Component.AddRuntimeMessage(ghK.GH_RuntimeMessageLevel.Remark, msg)
            new_room_vol = LBT2PH.spaces.Volume( tfa_srfc )
    else:
        new_room_vol = LBT2PH.spaces.Volume( tfa_srfc )
    
    # --------------------------------------------------------------------------
    # Sort the new Room Volume into the master Dict based on name
    if new_room_vol.dict_key in phpp_rooms_dict.keys():
        phpp_rooms_dict[new_room_vol.dict_key].append( new_room_vol )
    else:
        phpp_rooms_dict[new_room_vol.dict_key] = [ new_room_vol ]


#-------------------------------------------------------------------------------
# Build the final Rooms from all the the Room Volume Objects
phpp_spaces_ = []

for room_volumes in phpp_rooms_dict.values():
    # Create a single new Room from the list of Room Volumes
    new_room_obj = LBT2PH.spaces.Space( room_volumes )
    phpp_spaces_.append( new_room_obj )

#-------------------------------------------------------------------------------
# Pack the spaces into the HB Room/Zone object's user_data
HB_rooms_ = []
space_breps_ = []
for hb_room in _HB_rooms:
    # Initialize the new param dict
    user_data = {}
    user_data['phpp'] = {}
    user_data['phpp']['vent_system'] = {}
    user_data['phpp']['spaces'] = {}
    
    #---------------------------------------------------------------------------
    # Build a default ventilation system, apply it to the HB Room
    # Add the vent system data to the user_data
    default_ventilation_system = LBT2PH.ventilation.PHPP_Sys_Ventilation(_ghenv=ghenv, _system_id='default')
    user_data['phpp']['vent_system'] = default_ventilation_system.to_dict()
    
    #---------------------------------------------------------------------------
    # Add the new PHPP Spaces onto the HB Room
    for phpp_space in phpp_spaces_:
        if hb_room.display_name == phpp_space.host_room_name:
            key = '{}_{}'.format(phpp_space.dict_key, phpp_space.id)
            space = { key : phpp_space.to_dict() }
            user_data['phpp']['spaces'].update( space )
        
        # Grab the brep for preview as well
        space_breps_.extend(phpp_space.space_breps)
    
    #---------------------------------------------------------------------------
    # Set the user_data dict on the Honeybee Room with all the new param info
    new_hb_room = hb_room.duplicate()
    new_hb_room.user_data = user_data
    
    HB_rooms_.append(new_hb_room)
# ---------- end phpp_rooms_from_rhino ----------
create_vent_system = BT_CreateNewPHPPVentSystem(
    vent_system_name="My_Vent_System",
    vent_unit=ventilator.ventUnit,
    hrvDuct_02=vent_duct.hrvDuct,
    exhaust_vent_units=[exhaust_vent_2.exhaustVent, exhaust_vent.exhaustVent])  # -> out, vent_system; inputs hrvDuct_01: list, hrvDuct_02: list, exhaust_vent_units: list; plug-in component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

# ----
# Download EPW File
panel_12 = Panel("https://www.energyplus.net/weather-download/north_and_central_america_wmo_region_4/USA/MA/USA_MA_Boston-Logan.Intl.AP.725090_TMY3/all")  # disabled
downloadepw = LBDownloadWeather(weather_URL=panel_12)  # -> epw_file, stat_file, ddy_file; disabled; plug-in component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

# ----
# Spaces need to calculate
# - tfa area,
# - volume
# - clear ceiling height
brep_2 = Brep(phpp_rooms_from_rhino.space_breps)
# Flow rates... ughhhhh
room_vent_flowrates = BT_CalcVentFlowRates()  # -> out, HBZones, port, ventilationPerArea, ventilationPerPerson; inputs HBZones: list, phppVentSched: list; plug-in component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
set_zone_vent = BT_SetZoneVentSystem(vent_system=create_vent_system.vent_system, HB_rooms=flatten(phpp_rooms_from_rhino.HB_rooms))  # -> out, HB_rooms; inputs HB_rooms: list; plug-in component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
panel_13 = Panel(simpar)  # disabled
connect_to_run__to_only_write_idf = Panel("2")  # disabled

# ----
# Download EPW File
panel_14 = Panel("https://www.energyplus.net/weather-download/north_and_central_america_wmo_region_4/USA/MA/USA_MA_Boston-Logan.Intl.AP.725090_TMY3/all")
downloadepw_2 = LBDownloadWeather(weather_URL=panel_14)  # -> epw_file, stat_file, ddy_file; plug-in component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

toggle_2 = BooleanToggle(False)  # disabled
vizbytype = HBVisualizeByType(rooms=model.model)  # -> walls, interior_walls, roofs, ceilings, exterior_floors, interior_floors, air_walls, apertures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; disabled; plug-in component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
modeltoosm = HBModelToOSM(model=model.model, epw_file=downloadepw.epw_file, sim_par=simpar, write=toggle_2, run=toggle_2)  # -> report, jsons, osw, osm, idf, sql, zsz, rdd, html; disabled; plug-in component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
model_2 = HBModel(rooms=flatten(set_zone_vent.HB_rooms), name="Test Model")  # -> report, model; plug-in component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
vizbytype_2 = HBVisualizeByType(rooms=model_2.model)  # -> walls, interior_walls, roofs, ceilings, exterior_floors, interior_floors, air_walls, apertures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; plug-in component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
python = GhPythonScript(x=set_zone_vent.HB_rooms)  # -> out, a
# ---------- python: Python ----------
import json
print json.dumps(x.user_data, indent=2)
# ---------- end python ----------

# ----
# Visualize Results
roomenergyresult = HBReadRoomEnergyResult(sql=modeltoosm.sql)  # -> cooling, heating, lighting, electric_equip, gas_equip, fan_electric, pump_electric, people_gain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; disabled; plug-in component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
hourlyplot = LBHourlyPlot(data=[roomenergyresult.cooling, roomenergyresult.heating, roomenergyresult.fan_electric, roomenergyresult.pump_electric])  # -> report, mesh, legend, borders, labels, title; disabled; plug-in component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

# ----
# Optionally Execute Simulations in Parallel
data = Data(modeltoosm.osw)  # disabled
data_2 = Data(modeltoosm.idf)  # disabled
data_3 = Data(downloadepw.epw_file)  # disabled
rec = DataRecorder(data, DataLimit=-10, RecordData=True)  # disabled
rec_2 = DataRecorder(data_2, DataLimit=-10, RecordData=True)  # disabled
toggle_3 = BooleanToggle(False)  # disabled
toggle_4 = BooleanToggle(False)  # disabled
toggle_5 = BooleanToggle(True)  # disabled
toggle_6 = BooleanToggle(True)  # disabled
runidf = HBRunIDF(idf=rec_2, epw_file=data_3, parallel=toggle_5, run=toggle_4)  # -> report, sql, zsz, rdd, html; disabled; plug-in component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
runosw = HBRunOSW(osw=rec, epw_file=data_3, parallel=toggle_6, translate=toggle_3, run=toggle_3)  # -> report, osm, idf, sql, zsz, rdd, html; disabled; plug-in component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

panel_15 = Panel(python.out)
lbt_phpp_objs = LBT2PH_ConvertLBT2PHPPObjs(epw_file=downloadepw_2.epw_file, model=model_2.model)  # -> out, PHPP_Objs; plug-in component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
panel_16 = Panel(lbt_phpp_objs.PHPP_Objs)
create_excel_obj_geom = LBT2PH_CreateXLObj_Geom(PHPPObjs=lbt_phpp_objs.PHPP_Objs)  # -> out, toPHPP_Geom; inputs PHPPObjs: tree, zonesInclude: list, zoneExclude: list, tfa: list, thermalBridges: list, grndFloorElements: list, udRowStarts: list; plug-in component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
branch = TreeBranch(Tree=create_excel_obj_geom.toPHPP_Geom, Path="{5}", MaintainPaths=True)
branch_2 = TreeBranch(Tree=create_excel_obj_geom.toPHPP_Geom, Path="{7}", MaintainPaths=True)
panel_18 = Panel(branch_2)
panel_19 = Panel(branch)
open_xl_workbook = BT_XLOpenWorkbook(
    run=Toggle(False),
    oldFilename="C:\LBT2PH_Testing\_source.xlsx",
    newDirectory="C:\LBT2PH_Testing\",
    newFilename="output3")  # -> excel; plug-in component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
write_xl_workbook = BT_XLWriteWorkbook(excel=open_xl_workbook, XL_Objects=create_excel_obj_geom.toPHPP_Geom)  # -> excel, numWrites; inputs XL_Objects: tree; plug-in component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
