# Grasshopper definition LBT_1_Testing.gh (Grasshopper 1.0.7)

ladybug = Ladybug_Ladybug()  # -> Vviiiiiiiiiizzz; plug-in component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
honeybee = Honeybee_Honeybee()  # -> Vviiiiiiiiiizzz; plug-in component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
idf2phpp = BT_CORE()  # -> out; plug-in component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
windowmat = HBWindowMaterial(name="T", u_factor="1", shgc=".6")  # -> mat; plug-in component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
panel = Panel("""my_name_1
my_name_2""")
windowconstr = HBWindowConstruction(name="t", materials=windowmat)  # -> constr; plug-in component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
decnstrconstr = HBDeconstructConstruction(constr=windowconstr)  # -> materials, layers, r_val_si, r_val_ip, u_fac_si, u_fac_ip, t_sol, t_vis; plug-in component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
geo = Geometry([<brep referenced from the Rhino model> x6])
get_surface_params = GhPythonScript(srfcs=geo, auto_orientation=Toggle(True))  # -> out, geo, name, type, bc, ep_const, rad_mod; inputs srfcs: list of Guid
# ---------- get_surface_params: Python ----------
import rhinoscriptsyntax as rs
import scriptcontext as sc
import Rhino
import ghpythonlib.components as ghc
from imp import reload
import LBT2PH
import LBT2PH.helpers
import LBT2PH.assemblies
import LBT2PH.surfaces

#-------------------------------------------------------------------------------
reload(LBT2PH)
reload(LBT2PH.helpers)
reload(LBT2PH.assemblies)
reload(LBT2PH.surfaces)

#-------------------------------------------------------------------------------
def cleanSrfcInput(_srfcsInput):
    """If Brep or Polysrfc are input, explode them"""
    
    outputSrfcs = []
    
    with LBT2PH.helpers.context_rh_doc(ghdoc):
        for inputObj in _srfcsInput:
            if isinstance(rs.coercesurface(inputObj), Rhino.Geometry.BrepFace):
                # Catches Bare surfaces
                outputSrfcs.append(inputObj)
            elif isinstance(rs.coercebrep(inputObj), Rhino.Geometry.Brep):
                # Catches Polysurfaces / Extrusions or other Masses
                faces = ghc.DeconstructBrep(rs.coercebrep(inputObj)).faces
                if isinstance(faces, list):
                    for face in faces:
                        outputSrfcs.append(face)
            elif isinstance(rs.coercegeometry(inputObj), Rhino.Geometry.PolylineCurve):
                # Catches PolylineCurves
                if not rs.coercegeometry(inputObj).IsClosed:
                    warn = 'Non-Closed Polyline Curves found. Make sure all curves are closed.'
                    ghenv.Component.AddRuntimeMessage(ghK.GH_RuntimeMessageLevel.Remark, warn)
                else:
                    faces = ghc.DeconstructBrep(rs.coercegeometry(inputObj)).faces
                    if isinstance(faces, list):
                        for face in faces:
                            outputSrfcs.append(face)
                    else:
                        outputSrfcs.append(faces)
    
    return outputSrfcs

#-------------------------------------------------------------------------------
# Get the Surface data from the RH Scene
srfcs_to_use = cleanSrfcInput(_srfcs)
rh_surfaces = LBT2PH.surfaces.get_rh_srfc_params(srfcs_to_use, ghenv, ghdoc)

if auto_orientation_:
    rh_surfaces = LBT2PH.surfaces.determine_surface_type_by_orientation(rh_surfaces)

#-------------------------------------------------------------------------------
# Get all the Assemblies from the RH Scene
rh_doc_constructions = LBT2PH.assemblies.get_constructions_from_rh(ghdoc)
hb_constructions = LBT2PH.assemblies.generate_all_HB_constructions(rh_doc_constructions, ghenv, sc.sticky)

#-------------------------------------------------------------------------------
# Create the surface objects
hb_surfaces = [LBT2PH.surfaces.hb_surface(srfc, hb_constructions, ghenv) for srfc in rh_surfaces]

#-------------------------------------------------------------------------------
# Outputs
geo_ = []
name_ = []
type_ = []
bc_ = []
ep_const_ = []
rad_mod_ = []
for hb_srfc in hb_surfaces:
    geo_.append(hb_srfc.geometry)
    name_.append(hb_srfc.name)
    type_.append(hb_srfc.type)
    bc_.append(hb_srfc.bc)
    ep_const_.append(hb_srfc.const)
    rad_mod_.append(hb_srfc.rad_mod)
# ---------- end get_surface_params ----------
customgapmat = HBCustomWindowGapMaterial()  # -> mat; disabled; plug-in component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
gapmat = HBWindowGapMaterial()  # -> mat; disabled; plug-in component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
geo_2 = Geometry([<brep referenced from the Rhino model> x2])
new_phpp_frame = BT_CreatePHPPwindowFrame(name="gh_scene_frame")  # -> out, PHPPFrame; inputs frameWidths: list, frameUvalues: list, psiGlazings: list, psiInstalls: list; plug-in component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
new_phpp_glazing = BT_CreatePHPPwindowGlazing(name="gh_scene_glass")  # -> out, PHPPGlazing; plug-in component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
aperture = HBAperture(geo=geo_2)  # -> report, apertures; plug-in component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

# ---- group: Dynamically Chage Glazing Ratio
number_slider = Slider(0.4, range=-0.1..0.9)  # disabled

# ----
# Create Honeybee Model
panel_2 = Panel("outdoors")  # disabled
panel_3 = Panel("adiabatic")  # disabled
geo_3 = Geometry([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])  # disabled
geo_4 = Geometry(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)  # disabled
face = HBFace(geo=geo_3, bc=panel_2)  # -> report, faces; disabled; plug-in component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
face_2 = HBFace(geo=geo_4, bc=panel_3)  # -> report, faces; disabled; plug-in component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
panel_4 = Panel("2013::LargeOffice::OpenOffice")  # disabled
panel_5 = Panel("2013::ClimateZone5::SteelFramed")  # disabled
aperturesbyratio = HBAperturesByRatio(hb_objs=flatten(face.faces), ratio=number_slider)  # -> report, hb_objs; disabled; plug-in component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
all_air = HBAllAirHVACTemplates({"VAV chiller with gas boiler reheat", "VAV chiller with central air source heat pump reheat", "VAV chiller with district hot water reheat", "VAV chiller with PFP boxes", "VAV chiller with gas coil reheat", "VAV air-cooled chiller with gas boiler reheat", "VAV air-cooled chiller with central air source heat pump reheat", "VAV air-cooled chiller with district hot water reheat", "VAV air-cooled chiller with PFP boxes", "VAV air-cooled chiller with gas coil reheat"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}, selected="VAV chiller with gas boiler reheat")  # disabled
panel_6 = Panel("Office Shoe Box")  # disabled
panel_7 = Panel("ShoeBox")  # disabled
room = HBRoom(
    faces=flatten([face_2.faces, aperturesbyratio.hb_objs]),
    name=panel_6,
    constr_set=panel_5,
    program=panel_4,
    conditioned=True)  # -> report, room; disabled; plug-in component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
panel_8 = Panel("DifferentialDryBulb")  # disabled
concat = Concatenate(FragmentA=panel_7, FragmentB=number_slider)  # disabled
panel_9 = Panel("VAV System")  # disabled
allairhvac = HBAllAirHVAC(rooms=flatten(room.room), system_type=all_air, name=panel_9)  # -> report, rooms; disabled; plug-in component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
model = HBModel(rooms=flatten(allairhvac.rooms), name=concat)  # -> report, model; disabled; plug-in component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

face_3 = HBFace(
    geo=get_surface_params.geo,
    name=get_surface_params.name,
    type=get_surface_params.type,
    bc=get_surface_params.bc,
    ep_constr=get_surface_params.ep_const)  # -> report, faces; plug-in component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
glassmat = HBGlassMaterial()  # -> mat; disabled; plug-in component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
windowmat_2 = HBWindowMaterial()  # -> mat; disabled; plug-in component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
panel_10 = Panel(new_phpp_glazing.PHPPGlazing)
panel_11 = Panel(new_phpp_frame.PHPPFrame)
room_2 = HBRoom(faces=flatten(face_3.faces), name="Test Room", conditioned=True)  # -> report, room; plug-in component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
phpp_window = GhPythonScript(apertures=aperture.apertures)  # -> out, apertures; inputs apertures: list, frames: list, glazings: list, psi_installs: list, installs: list
# ---------- phpp_window: Python ----------
import System
import Rhino
import rhinoscriptsyntax as rs
import json

import LBT2PH
import LBT2PH.windows
reload(LBT2PH)
reload(LBT2PH.windows)

def aperture_sources():
    ''' Find the component input source with the name "apertures" '''
    
    for input in ghenv.Component.Params.Input:
        if input.NickName == 'apertures':
            return input.Sources[0]
    
    return None

def window_rh_Guids():
    ''' Work backwards to get the Guid of the original input geom '''
    
    apertures = aperture_sources()
    if apertures is None:
        return None
    
    hb_aperture_compo = apertures.Attributes.GetTopLevel.DocObject
    
    rh_doc_window_guids = []
    for input in hb_aperture_compo.Params.Input[0].VolatileData[0]:
        guid_as_str = input.ReferenceID.ToString() 
        
        try:
            rh_doc_window_guids.append( System.Guid(guid_as_str) )
        except:
            rh_doc_window_guids.append( None )
    
    return rh_doc_window_guids

def cleanInput(_inputList, targetListLength,):
    # Used to make sure the input lists are all the same length
    # if the input param list isn't the same, use only the first item for all
    
    output = []
    if len(_inputList) == targetListLength:
        for each in _inputList:
            output.append(each)
    elif len(_inputList) >= 1:
        for i in range(targetListLength):
            output.append(_inputList[0])
    elif len(_inputList) == 0:
        for i in range(targetListLength):
            output.append(None)
    
    return output

#-------------------------------------------------------------------------------
# Clean the GH component inputs
ud_frames = cleanInput(frames_, len(apertures))
ud_glazings = cleanInput(glazings_, len(apertures))
ud_psi_installs = cleanInput(psi_installs_, len(apertures))
ud_installs = cleanInput(installs_, len(apertures))
gh_inputs = zip(ud_frames, ud_glazings, ud_psi_installs,  ud_installs)

#-------------------------------------------------------------------------------
# Get the Rhino Scene UserText (window Library)
rh_doc_window_library = LBT2PH.windows.get_rh_doc_window_library(ghdoc)

apertures_ = []
window_guids = window_rh_Guids()
for aperture, window_guid, gh_input in zip(apertures, window_guids, gh_inputs):
    # Get the Window data from the scene (name, params, etc)
    # If its a generic dbl pane, that means no GH user-determined input
    # so go try and find values from the Rhino scene instead
    if aperture.properties.energy.construction.display_name == 'Generic Double Pane':
        aperture_params = LBT2PH.windows.get_rh_window_obj_params(ghdoc, window_guid )
    else:
        aperture_params = {}
    
    # Apply any Grasshopper Scene user-determined values
    ud_f, ud_g, ud_psi, ud_i = gh_input
    
    if ud_f: aperture_params['FrameType'] = json.dumps(ud_f.to_dict())
    if ud_g: aperture_params['GlazingType'] = json.dumps(ud_g.to_dict())
    if ud_psi: aperture_params['FrameType'] = ud_psi
    if ud_i:
        aperture_params['InstallLeft'] = ud_i
        aperture_params['InstallRight'] = ud_i
        aperture_params['InstallBottom'] = ud_i
        aperture_params['InstallTop'] = ud_i
    
    #---------------------------------------------------------------------------
    # Create a new 'Window' Object based on the aperture, params, component library
    window_obj = LBT2PH.windows.PHPP_Window(aperture, aperture_params, rh_doc_window_library)
    
    # Create EP Constructions for each window (based on frame / glass)
    window_EP_material = LBT2PH.windows.create_EP_window_mat( window_obj )
    window_EP_const = LBT2PH.windows.create_EP_const( window_EP_material )
    
    # Create a new Aperture object and modify it's properties
    new_ap = aperture.duplicate()
    new_ap.properties.energy.construction = window_EP_const
    
    #---------------------------------------------------------------------------
    # Package up the data onto the 'Aperture' objects
    if new_ap.user_data is None:
        new_ap.user_data = {}
    if not new_ap.user_data.has_key('phpp'):
        new_ap.user_data['phpp'] = {}
        new_ap.user_data['phpp']['aperture_params'] = aperture_params
    else:
        new_ap.user_data['phpp']['aperture_params'] = aperture_params
    
    apertures_.append(new_ap)
# ---------- end phpp_window ----------
read_idf_file = BT_ReadIDFfile()  # -> out, IDF_Objs_List, port, surfaces, fenestration, constuctions, materials; disabled; plug-in component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
panel_12 = Panel(phpp_window.apertures)
addsubface = HBAddSubface(hb_obj=flatten(room_2.room), sub_faces=flatten(phpp_window.apertures))  # -> hb_obj; plug-in component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

# ----
# Download EPW File
panel_13 = Panel("https://www.energyplus.net/weather-download/north_and_central_america_wmo_region_4/USA/MA/USA_MA_Boston-Logan.Intl.AP.725090_TMY3/all")
downloadepw = LBDownloadWeather(weather_URL=panel_13)  # -> epw_file, stat_file, ddy_file; plug-in component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

idf_phpp_objs = BT_IDF2PHPPObjs(IDF_Objs_List=read_idf_file.IDF_Objs_List)  # -> out, opaqueSurfaces, windowObjects, zoneNames, PHPPObjs; inputs HBZones: list, IDF_Objs_List: list; disabled; plug-in component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

# ----
# Request Outputs
toggle = BooleanToggle(True)  # disabled
simoutput = HBSimulationOutput(zone_energy_use=toggle, hvac_energy_use=toggle)  # -> report, sim_output; disabled; plug-in component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
simpar = HBSimulationParameter(output=simoutput.sim_output, timestep=6)  # -> sim_par; disabled; plug-in component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

python = GhPythonScript()  # -> out, a; disabled
# ---------- python: Python ----------
print('{:02d}'.format( int(4.02) ))
# ---------- end python ----------
model_2 = HBModel(rooms=flatten(addsubface), name="Test Model")  # -> report, model; plug-in component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
panel_14 = Panel(model_2.model)

# ----
# Download EPW File
panel_15 = Panel("https://www.energyplus.net/weather-download/north_and_central_america_wmo_region_4/USA/MA/USA_MA_Boston-Logan.Intl.AP.725090_TMY3/all")  # disabled
downloadepw_2 = LBDownloadWeather(weather_URL=panel_15)  # -> epw_file, stat_file, ddy_file; disabled; plug-in component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

vizbytype = HBVisualizeByType(rooms=model_2.model)  # -> walls, interior_walls, roofs, ceilings, exterior_floors, interior_floors, air_walls, apertures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; plug-in component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
python_2 = GhPythonScript(model=model_2.model)  # -> out, a; inputs model: list
# ---------- python_2: Python ----------
import json

for m in model:
    for a in m.apertures:
        print '- '*50
        print a.user_data
        print a.user_data['phpp']['aperture_params']
        print '- '*25
        print(a.user_data['phpp']['aperture_params']['GlazingType'])
        j = json.loads(a.user_data['phpp']['aperture_params']['GlazingType'])
        print j['_nm']
        print
        j = json.loads(a.user_data['phpp']['aperture_params']['FrameType'])
        print j['_nm']
        
        #print a.properties.energy.construction
# ---------- end python_2 ----------
panel_16 = Panel(python_2.out)
panel_17 = Panel(simpar)  # disabled
lbt_phpp_objs = GhPythonScript(epw_file=downloadepw.epw_file, model=model_2.model)  # -> out, PHPP_Objs
# ---------- lbt_phpp_objs: Python ----------
from System import Object
from Grasshopper import DataTree
from Grasshopper.Kernel.Data import GH_Path
import Rhino
import rhinoscriptsyntax as rs

import LBT2PH
import LBT2PH.lbt_to_phpp
reload(LBT2PH)
reload(LBT2PH.lbt_to_phpp)

#-------------------------------------------------------------------------------
# Set the north if it is not defaulted
# Import the ladybug_rhino dependencies
try:  
    from ladybug_rhino.togeometry import to_vector2d
except ImportError as e:
    raise ImportError('\nFailed to import ladybug_rhino:\n\t{}'.format(e))

if north_ is not None:
    try:
        north = to_vector2d(north_)
    except AttributeError as e:  # north angle instead of vector
        print(e)
        north = float(north_)
else:
    north = to_vector2d( Rhino.Geometry.Vector2d(1,2) )

#-------------------------------------------------------------------------------
# Get all the info from the LBT Model

materials_opaque = LBT2PH.lbt_to_phpp.get_opaque_materials_from_model(_model, ghenv)
constructions_opaque = LBT2PH.lbt_to_phpp.get_opaque_constructions_from_model(_model, ghenv)
surfaces_opaque = LBT2PH.lbt_to_phpp.get_exposed_surfaces_from_model(_model, north, ghenv)

materials_windows = LBT2PH.lbt_to_phpp.get_aperture_materials_from_model(_model)
constructions_windows = LBT2PH.lbt_to_phpp.get_aperture_constructions_from_model(_model)
surfaces_windows = LBT2PH.lbt_to_phpp.get_aperture_surfaces_from_model(_model, ghdoc)


phpp_rooms = []
phpp_ventilation_system = []

zones = LBT2PH.lbt_to_phpp.get_zones_from_model(_model)


# Zones, Zone Name List
# Zone Infiltration Rates
# Zone List
# Location
# PHPP Room info, Ventilation info

# Filter constructions into opaque / window

# find the climate if epw input




#-------------------------------------------------------------------------------
# Package up all the output objects
# into a single tree for passing

PHPP_Objs_ = DataTree[Object]()
# Materials and Constructions
PHPP_Objs_.AddRange(materials_opaque, GH_Path(0))
PHPP_Objs_.AddRange(constructions_opaque, GH_Path(1))
PHPP_Objs_.AddRange(materials_windows, GH_Path(2))
PHPP_Objs_.AddRange(constructions_windows, GH_Path(3))

# Surfaces
PHPP_Objs_.AddRange(surfaces_opaque, GH_Path(4))
PHPP_Objs_.AddRange(surfaces_windows, GH_Path(5))

# Zones
PHPP_Objs_.AddRange(phpp_rooms, GH_Path(6))               # List of all the HB Zone PHPP Rooms
PHPP_Objs_.AddRange(phpp_ventilation_system, GH_Path(7))  # List the Fresh Air Ventilation System Dictionary
PHPP_Objs_.AddRange(zones, GH_Path(8))                    # All of the Zones/Rooms
#PHPP_Objs_.AddRange(zoneInfiltrationRates, GH_Path(9))                           # Zone Infiltration Airflow rates
#PHPP_Objs_.AddRange(dhwSystemObj, GH_Path(10))
#PHPP_Objs_.AddRange(groundObjs, GH_Path(11))
#PHPP_Objs_.AddRange(climate, GH_Path(12)) 
#PHPP_Objs_.AddRange(elec_equip_appliances, GH_Path(13)) 
#PHPP_Objs_.AddRange(phpp_lighting, GH_Path(14)) 
#PHPP_Objs_.Add(footprint, GH_Path(15)) 

# Zone Names preview
# ---------- end lbt_phpp_objs ----------
panel_18 = Panel(lbt_phpp_objs.PHPP_Objs)
connect_to_run__to_only_write_idf = Panel("2")  # disabled
toggle_2 = BooleanToggle(False)  # disabled
vizbytype_2 = HBVisualizeByType(rooms=model.model)  # -> walls, interior_walls, roofs, ceilings, exterior_floors, interior_floors, air_walls, apertures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; disabled; plug-in component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
modeltoosm = HBModelToOSM(model=model.model, epw_file=downloadepw_2.epw_file, sim_par=simpar, write=toggle_2, run=toggle_2)  # -> report, jsons, osw, osm, idf, sql, zsz, rdd, html; disabled; plug-in component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
create_excel_obj_geom = BT_CreateXLObj_Geom(PHPPObjs=lbt_phpp_objs.PHPP_Objs)  # -> out, toPHPP_Geom; inputs PHPPObjs: tree, zonesInclude: list, zoneExclude: list, tfa: list, thermalBridges: list, grndFloorElements: list, udRowStarts: list; plug-in component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

# ----
# Visualize Results
roomenergyresult = HBReadRoomEnergyResult(sql=modeltoosm.sql)  # -> cooling, heating, lighting, electric_equip, gas_equip, fan_electric, pump_electric, people_gain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; disabled; plug-in component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
hourlyplot = LBHourlyPlot(data=[roomenergyresult.cooling, roomenergyresult.heating, roomenergyresult.fan_electric, roomenergyresult.pump_electric])  # -> report, mesh, legend, borders, labels, title; disabled; plug-in component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

# ----
# Optionally Execute Simulations in Parallel
data = Data(modeltoosm.osw)  # disabled
data_2 = Data(modeltoosm.idf)  # disabled
data_3 = Data(downloadepw_2.epw_file)  # disabled
rec = DataRecorder(data, DataLimit=-10, RecordData=True)  # disabled
rec_2 = DataRecorder(data_2, DataLimit=-10, RecordData=True)  # disabled
toggle_3 = BooleanToggle(False)  # disabled
toggle_4 = BooleanToggle(False)  # disabled
toggle_5 = BooleanToggle(True)  # disabled
toggle_6 = BooleanToggle(True)  # disabled
runidf = HBRunIDF(idf=rec_2, epw_file=data_3, parallel=toggle_5, run=toggle_4)  # -> report, sql, zsz, rdd, html; disabled; plug-in component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
runosw = HBRunOSW(osw=rec, epw_file=data_3, parallel=toggle_6, translate=toggle_3, run=toggle_3)  # -> report, osm, idf, sql, zsz, rdd, html; disabled; plug-in component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

open_xl_workbook = BT_XLOpenWorkbook(
    run=Toggle(False),
    oldFilename="C:\LBT2PH_Testing\_source.xlsx",
    newDirectory="C:\LBT2PH_Testing\",
    newFilename="output3")  # -> excel; plug-in component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
write_xl_workbook = BT_XLWriteWorkbook(excel=open_xl_workbook, XL_Objects=create_excel_obj_geom.toPHPP_Geom)  # -> excel, numWrites; inputs XL_Objects: tree; plug-in component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
