# Grasshopper definition LBT_2_Testing.gh (Grasshopper 1.0.7)

honeybee = Honeybee_Honeybee()  # -> Vviiiiiiiiiizzz; plug-in component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
ladybug = Ladybug_Ladybug()  # -> Vviiiiiiiiiizzz; plug-in component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
idf2phpp = BT_CORE()  # -> out; plug-in component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
geo = Geometry([<brep referenced from the Rhino model> x6])
get_surface_params = LBT2PH_GetSrfcParams(srfcs=geo, auto_orientation=Toggle(False))  # -> out, geo, name, type, bc, ep_const, rad_mod; inputs srfcs: list of Guid; plug-in component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
customgapmat = HBCustomWindowGapMaterial()  # -> mat; disabled; plug-in component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
gapmat = HBWindowGapMaterial()  # -> mat; disabled; plug-in component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
geo_2 = Geometry([<brep referenced from the Rhino model> x2])
new_phpp_frame = LBT2PH_CreatePHPPwindowFrame(name="gh_scene_frame")  # -> out, PHPPFrame; inputs frameWidths: list, frameUvalues: list, psiGlazings: list, psiInstalls: list; plug-in component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
new_phpp_glazing = LBT2PH_CreatePHPPwindowGlazing(name="gh_scene_glass")  # -> out, PHPPGlazing; plug-in component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
aperture = HBAperture(geo=geo_2)  # -> report, apertures; plug-in component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

# ---- group: Dynamically Chage Glazing Ratio
number_slider = Slider(0.4, range=-0.1..0.9)  # disabled

# ----
# Create Honeybee Model
panel = Panel("outdoors")  # disabled
panel_2 = Panel("adiabatic")  # disabled
geo_3 = Geometry([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])  # disabled
geo_4 = Geometry(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)  # disabled
face = HBFace(geo=geo_3, bc=panel)  # -> report, faces; disabled; plug-in component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
face_2 = HBFace(geo=geo_4, bc=panel_2)  # -> report, faces; disabled; plug-in component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
panel_3 = Panel("2013::LargeOffice::OpenOffice")  # disabled
panel_4 = Panel("2013::ClimateZone5::SteelFramed")  # disabled
aperturesbyratio = HBAperturesByRatio(hb_objs=flatten(face.faces), ratio=number_slider)  # -> report, hb_objs; disabled; plug-in component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
all_air = HBAllAirHVACTemplates({"VAV chiller with gas boiler reheat", "VAV chiller with central air source heat pump reheat", "VAV chiller with district hot water reheat", "VAV chiller with PFP boxes", "VAV chiller with gas coil reheat", "VAV air-cooled chiller with gas boiler reheat", "VAV air-cooled chiller with central air source heat pump reheat", "VAV air-cooled chiller with district hot water reheat", "VAV air-cooled chiller with PFP boxes", "VAV air-cooled chiller with gas coil reheat"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}, selected="VAV chiller with gas boiler reheat")  # disabled
panel_5 = Panel("Office Shoe Box")  # disabled
panel_6 = Panel("ShoeBox")  # disabled
room = HBRoom(
    faces=flatten([face_2.faces, aperturesbyratio.hb_objs]),
    name=panel_5,
    constr_set=panel_4,
    program=panel_3,
    conditioned=True)  # -> report, room; disabled; plug-in component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
panel_7 = Panel("DifferentialDryBulb")  # disabled
concat = Concatenate(FragmentA=panel_6, FragmentB=number_slider)  # disabled
panel_8 = Panel("VAV System")  # disabled
allairhvac = HBAllAirHVAC(rooms=flatten(room.room), system_type=all_air, name=panel_8)  # -> report, rooms; disabled; plug-in component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
model = HBModel(rooms=flatten(allairhvac.rooms), name=concat)  # -> report, model; disabled; plug-in component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

face_3 = HBFace(
    geo=get_surface_params.geo,
    name=get_surface_params.name,
    type=get_surface_params.type,
    bc=get_surface_params.bc,
    ep_constr=get_surface_params.ep_const)  # -> report, faces; plug-in component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
glassmat = HBGlassMaterial()  # -> mat; disabled; plug-in component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
windowmat = HBWindowMaterial()  # -> mat; disabled; plug-in component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
phpp_aperture = LBT2PH_CreatePHPPAperture(apertures=aperture.apertures)  # -> out, apertures; inputs apertures: list, frames: list, glazings: list, psi_installs: list, installs: list; plug-in component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
room_2 = HBRoom(faces=flatten(face_3.faces), name="Test Room", conditioned=True)  # -> report, room; plug-in component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
panel_9 = Panel(new_phpp_glazing.PHPPGlazing)
panel_10 = Panel(new_phpp_frame.PHPPFrame)
read_idf_file = BT_ReadIDFfile()  # -> out, IDF_Objs_List, port, surfaces, fenestration, constuctions, materials; disabled; plug-in component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
addsubface = HBAddSubface(hb_obj=flatten(room_2.room), sub_faces=flatten(phpp_aperture.apertures))  # -> hb_obj; plug-in component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

# ----
# Download EPW File
panel_11 = Panel("https://www.energyplus.net/weather-download/north_and_central_america_wmo_region_4/USA/MA/USA_MA_Boston-Logan.Intl.AP.725090_TMY3/all")
downloadepw = LBDownloadWeather(weather_URL=panel_11)  # -> epw_file, stat_file, ddy_file; plug-in component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

idf_phpp_objs = BT_IDF2PHPPObjs(IDF_Objs_List=read_idf_file.IDF_Objs_List)  # -> out, opaqueSurfaces, windowObjects, zoneNames, PHPPObjs; inputs HBZones: list, IDF_Objs_List: list; disabled; plug-in component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

# ----
# Request Outputs
toggle = BooleanToggle(True)  # disabled
simoutput = HBSimulationOutput(zone_energy_use=toggle, hvac_energy_use=toggle)  # -> report, sim_output; disabled; plug-in component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
simpar = HBSimulationParameter(output=simoutput.sim_output, timestep=6)  # -> sim_par; disabled; plug-in component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

python = GhPythonScript()  # -> out, a; disabled
# ---------- python: Python ----------
print('{:02d}'.format( int(4.02) ))
# ---------- end python ----------
model_2 = HBModel(rooms=flatten(addsubface), name="Test Model")  # -> report, model; plug-in component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

# ----
# Download EPW File
panel_12 = Panel("https://www.energyplus.net/weather-download/north_and_central_america_wmo_region_4/USA/MA/USA_MA_Boston-Logan.Intl.AP.725090_TMY3/all")  # disabled
downloadepw_2 = LBDownloadWeather(weather_URL=panel_12)  # -> epw_file, stat_file, ddy_file; disabled; plug-in component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

vizbytype = HBVisualizeByType(rooms=model_2.model)  # -> walls, interior_walls, roofs, ceilings, exterior_floors, interior_floors, air_walls, apertures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; plug-in component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
python_2 = GhPythonScript(model=model_2.model)  # -> out, a; inputs model: list; disabled
# ---------- python_2: Python ----------
import json

for m in model:
    for a in m.apertures:
        print '- '*50
        print a.user_data
        print a.user_data['phpp']['aperture_params']
        print '- '*25
        print(a.user_data['phpp']['aperture_params']['GlazingType'])
        j = json.loads(a.user_data['phpp']['aperture_params']['GlazingType'])
        print j['_nm']
        print
        j = json.loads(a.user_data['phpp']['aperture_params']['FrameType'])
        print j['_nm']
        
        #print a.properties.energy.construction
# ---------- end python_2 ----------
panel_13 = Panel(python_2.out)  # disabled
panel_14 = Panel(simpar)  # disabled
lbt_phpp_objs = LBT2PH_ConvertLBT2PHPPObjs(epw_file=downloadepw.epw_file, model=model_2.model)  # -> out, PHPP_Objs; plug-in component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
panel_15 = Panel(lbt_phpp_objs.PHPP_Objs)
connect_to_run__to_only_write_idf = Panel("2")  # disabled
toggle_2 = BooleanToggle(False)  # disabled
vizbytype_2 = HBVisualizeByType(rooms=model.model)  # -> walls, interior_walls, roofs, ceilings, exterior_floors, interior_floors, air_walls, apertures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; disabled; plug-in component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
modeltoosm = HBModelToOSM(model=model.model, epw_file=downloadepw_2.epw_file, sim_par=simpar, write=toggle_2, run=toggle_2)  # -> report, jsons, osw, osm, idf, sql, zsz, rdd, html; disabled; plug-in component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
create_excel_obj_geom = LBT2PH_CreateXLObj_Geom(PHPPObjs=lbt_phpp_objs.PHPP_Objs)  # -> out, toPHPP_Geom; inputs PHPPObjs: tree, zonesInclude: list, zoneExclude: list, tfa: list, thermalBridges: list, grndFloorElements: list, udRowStarts: list; plug-in component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

# ----
# Visualize Results
roomenergyresult = HBReadRoomEnergyResult(sql=modeltoosm.sql)  # -> cooling, heating, lighting, electric_equip, gas_equip, fan_electric, pump_electric, people_gain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; disabled; plug-in component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
hourlyplot = LBHourlyPlot(data=[roomenergyresult.cooling, roomenergyresult.heating, roomenergyresult.fan_electric, roomenergyresult.pump_electric])  # -> report, mesh, legend, borders, labels, title; disabled; plug-in component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

# ----
# Optionally Execute Simulations in Parallel
data = Data(modeltoosm.osw)  # disabled
data_2 = Data(modeltoosm.idf)  # disabled
data_3 = Data(downloadepw_2.epw_file)  # disabled
rec = DataRecorder(data, DataLimit=-10, RecordData=True)  # disabled
rec_2 = DataRecorder(data_2, DataLimit=-10, RecordData=True)  # disabled
toggle_3 = BooleanToggle(False)  # disabled
toggle_4 = BooleanToggle(False)  # disabled
toggle_5 = BooleanToggle(True)  # disabled
toggle_6 = BooleanToggle(True)  # disabled
runidf = HBRunIDF(idf=rec_2, epw_file=data_3, parallel=toggle_5, run=toggle_4)  # -> report, sql, zsz, rdd, html; disabled; plug-in component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
runosw = HBRunOSW(osw=rec, epw_file=data_3, parallel=toggle_6, translate=toggle_3, run=toggle_3)  # -> report, osm, idf, sql, zsz, rdd, html; disabled; plug-in component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

open_xl_workbook = BT_XLOpenWorkbook(
    run=Toggle(False),
    oldFilename="C:\LBT2PH_Testing\_source.xlsx",
    newDirectory="C:\LBT2PH_Testing\",
    newFilename="output3")  # -> excel; plug-in component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
write_xl_workbook = BT_XLWriteWorkbook(excel=open_xl_workbook, XL_Objects=create_excel_obj_geom.toPHPP_Geom)  # -> excel, numWrites; inputs XL_Objects: tree; plug-in component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
